# Dynamo graph ReadResults_WriteToRevit.dyn (Dynamo 0.8.1.1942)

# group: Instructions

# group: 6. SET TO TRUE
# note: Set the boolean to True to export the model

# group: 7. ONCE THE MODEL HAS BEEN EXPORTED TO SAP, SET TO TRUE
# note: Set the boolean to True to run the analysis

# group: IMPORT PARAMETERS INTO REVIT
# note: Once the values have been saved, go to General Tools under the CORE Tools Tab in Revit and click on Import Parameter from Excel. This will write the results from the SAP analysis into the corresponding family instance parameters

# group: 1. SELECT THE REVIT OBJECTS TO ANALYZE
# note: Select both the analytical and the physical models

# group: 5. SELECT UNITS
# note: Check the Revit Model units and select the appropriate units below

# group: 2. OPEN A SAP INSTANCE
# note: This will make sure that the sections catalogs are imported correctly

# group: 3. CREATE THE LOADING CONDITIONS
# note: Define a load pattern and the loads to apply

# group: 4. SET RESTRAINTS
# note: Define the restraints in the model

# group: 8. CHOOSE WHICH RESULTS TO VISUALIZE
# note: Move the integer slider to get other analysys results and visuale them

# group: Read Revit Model
# note: Select elements and their analytical model
select_model_elements = DSModelElementsSelection()  # 390 picked in the model
# note: Get the section names
name = Family.Name(select_model_elements)
watch = Watch(select_model_elements)

# group: Get the lines of the analytical models
python_script = Python(IN[0]=select_model_elements)
# ---------- python_script.python (27 lines) ----------
import clr
clr.AddReference('RevitAPI')
from Autodesk.Revit.DB import *
from Autodesk.Revit.DB import Structure

clr.AddReference("RevitServices")
import RevitServices
from RevitServices.Persistence import DocumentManager

clr.AddReference("RevitNodes")
import Revit
clr.ImportExtensions(Revit.GeometryConversion)

doc = DocumentManager.Instance.CurrentDBDocument
items = UnwrapElement(IN[0])

analyticalModel = list()
for item in items:
	try: 
		
		curve = (doc.GetElement(item.Id)).GetCurve().ToProtoType()
		analyticalModel.append(curve)
	except:
		#typelist.append(list())
		t="no"
		
OUT = analyticalModel
# ----------------------------------------

# group: Remove empty elements
python_script_2 = Python(IN[0]=name)
# ---------- python_script_2.python (22 lines) ----------
import clr
clr.AddReference('RevitAPI')
from Autodesk.Revit.DB import *
from Autodesk.Revit.DB import Structure

clr.AddReference("RevitServices")
import RevitServices
from RevitServices.Persistence import DocumentManager

clr.AddReference("RevitNodes")
import Revit
clr.ImportExtensions(Revit.GeometryConversion)

doc = DocumentManager.Instance.CurrentDBDocument
items = UnwrapElement(IN[0])
typelist = list()
mm = list()
for item in items:
	if (item != ""):
		mm.append(item)
		
OUT = mm
# ----------------------------------------

# group: Define SAP sections
# note: Select the catalog to get the sections from
sectionCatalogs = SectionCatalogs("EURO")
# note: Define the sections
define = DynamoSAP.Definitions.SectionProp.Define(python_script_2, arg2=sectionCatalogs)
sections = DynamoSAP.Definitions.SectionProp.Sections(sectionCatalogs)

# group: Get the Revit element rotation angle
code_block = CodeBlock { "Cross-Section Rotation"; }
getParameterValueByName = Element.GetParameterValueByName(element=select_model_elements, parameterName=code_block)

categories = Categories("StructuralColumns")

# group: Logic to extract the Revit rotation angle
python_script_3 = Python(IN[0]=name, IN[1]=getParameterValueByName, IN[2]=select_model_elements, IN[3]=categories)
# ---------- python_script_3.python (31 lines) ----------
import clr
clr.AddReference('RevitAPI')
from Autodesk.Revit.DB import *
from Autodesk.Revit.DB import Structure

clr.AddReference("RevitServices")
import RevitServices
from RevitServices.Persistence import DocumentManager

clr.AddReference("RevitNodes")
import Revit
clr.ImportExtensions(Revit.GeometryConversion)

doc = DocumentManager.Instance.CurrentDBDocument
items = UnwrapElement(IN[0])
angles = IN[1]
elements = UnwrapElement(IN[2])
cat = UnwrapElement(IN[3])
rotationList = list()
booleanList = list()

for i in range(0,len(items)):
	if (items[i] == ""):
		rotationList.append(angles[i])
	else:
		if elements[i].Category.Id==cat.Id:
			booleanList.append(True)
		else:
			booleanList.append(False)
		
OUT = (rotationList,booleanList)
# ----------------------------------------

revit_angles = List.FirstItem(python_script_3)
iscolumn = List.LastItem(python_script_3)

# group: Translate Revit rotation angles into SAP angles
revitToSAPRotationMapper = DynamoSAP.Structure.Frame.RevitToSAPRotationMapper(revit_angles, iscolumn)

# group: Create Frames from Lines
fromLine = DynamoSAP.Structure.Frame.FromLine(python_script, define, arg3=revitToSAPRotationMapper)

# group: Check if the start point has a Z value of 0
startPoint = Curve.StartPoint(python_script)
Z = Point.Z(startPoint)
code_block_2 = CodeBlock { 0; }

round = Math.Round(Z)

# group: Check if the start and the end points have the same Z value (checkf if they are horizontal beams)
endPoint = Curve.EndPoint(python_script)
Z_2 = Point.Z(endPoint)

round_2 = Math.Round(Z_2)

# group (continued): Check if the start and the end points have the same Z value (checkf if they are horizontal beams)
eq = round_2 == round

# group: Make a separate lists for beams and columns
filterByBoolMask = List.FilterByBoolMask(list=fromLine, mask=eq)

# group: Create Load Pattern
code_block_3 = CodeBlock { "LoadPatternTest"; }
loadPatternTypes = LoadPatternTypes("LTYPE_DEAD")
setLoadPattern = DynamoSAP.Definitions.LoadPattern.SetLoadPattern(code_block_3, loadPatternTypes)
loadType = LoadType("Force")

# group: Create Distributed Load
loadDirection = LoadDirection("b_GlobalZ")
code_block_4 = CodeBlock { 0.0; }
code_block_5 = CodeBlock { 1.0; }
code_block_6 = CodeBlock { -100; }
distributedLoad = DynamoSAP.Definitions.Load.DistributedLoad(setLoadPattern, loadType, loadDirection, code_block_4, code_block_5, code_block_6, code_block_6)

# group: Set Loads on Horizontal Frames
flatten = Flatten(filterByBoolMask.in)
code_block_7 = CodeBlock { true; }
setLoad = DynamoSAP.Structure.Frame.SetLoad(flatten, distributedLoad, code_block_7)

# group: Column frames
flatten_2 = Flatten(filterByBoolMask.out)

# group (continued): Check if the start point has a Z value of 0
eq_2 = round == code_block_2

# group: Get the the support points
filterByBoolMask_2 = List.FilterByBoolMask(list=startPoint, mask=eq_2)

# group: Set Restraints on support points
flatten_3 = Flatten(filterByBoolMask_2.in)
fromPoint = DynamoSAP.Structure.Joint.FromPoint(flatten_3)
fixed = DynamoSAP.Definitions.Restraint.Fixed()
setRestraint = DynamoSAP.Structure.Joint.SetRestraint(fromPoint, fixed)

# group: Structural Elements
create = List.Create(setLoad, flatten_2, setRestraint)
# note: Make sure to flatten the inputs before baking
flatten_4 = Flatten(create)

# group: Definitions
create_2 = List.Create(setLoadPattern)
flatten_5 = Flatten(create_2)

# group: Create DynamoSAP Structural Model
collector = DynamoSAP.Assembly.StructuralModel.Collector(flatten_4, flatten_5)

# group: Export model to SAP
boolean = BoolSelector(false)
units = Units("kN_mm_C")
toSAP = DynamoSAP.Assembly.Bake.ToSAP(collector, boolean, units)

# group: Run analysis in SAP
boolean_2 = BoolSelector(false)
run = DynamoSAP.Analysis.Analysis.Run(boolean_2)

watch_2 = Watch(run.out1)
integer_slider = IntegerSlider(2, range=0..2 step 1)
getItemAtIndex = List.GetItemAtIndex(list=watch_2, index=integer_slider)
watch_3 = Watch(getItemAtIndex)

# group: Get the results for a specific force type
getResults = DynamoSAP.Analysis.Analysis.GetResults(watch_3, boolean_2)
forceTypes = ForceTypes("Moment33")
decomposeResults = DynamoSAP.Analysis.Analysis.DecomposeResults(run.out0, getResults, forceTypes)
boolean_3 = BoolSelector(true)

code_block_8 = CodeBlock { 1000; }

# group: Visualize forces
visualizeResults = DynamoSAP.Analysis.Analysis.VisualizeResults(run.out0, getResults, forceTypes, boolean_3, code_block_8)

# group: Display Loads
code_block_9 = CodeBlock { 1000; }
displayLoads = DynamoSAP.Structure.Frame.DisplayLoads(collector, arg4=code_block_9)

# group: Revit
code_block_10 = CodeBlock { ""; }

# group: DynamoSAP
code_block_11 = CodeBlock { ""; }

# group: Other operations
code_block_12 = CodeBlock { ""; }

# group: Custom Python code
code_block_13 = CodeBlock { ""; }

# group: DynamoSAP visualization
code_block_14 = CodeBlock { ""; }

# group: Write to Excel in a sheet name with the same name of the load pattern
file_path = Filename("C:\Users\AGarciaPuyol\Desktop\ROMA\Roma_SAP forces.xlsx")
code_block_15 = CodeBlock { 0; }
boolean_4 = BoolSelector(true)
writeToFile = Excel.WriteToFile(filePath=file_path, sheetName=watch_3, startRow=code_block_15, startCol=code_block_15, overWrite=boolean_4)

# group: Analytical elements only
python_script_4 = Python(IN[0]=select_model_elements)
# ---------- python_script_4.python (29 lines) ----------
import clr
clr.AddReference('RevitAPI')
from Autodesk.Revit.DB import *
from Autodesk.Revit.DB import Structure

clr.AddReference("RevitServices")
import RevitServices
from RevitServices.Persistence import DocumentManager

clr.AddReference("RevitNodes")
import Revit
clr.ImportExtensions(Revit.GeometryConversion)

doc = DocumentManager.Instance.CurrentDBDocument
items = UnwrapElement(IN[0])
analytical = list()
mm = list()
for item in items:
	try: 
		
		curve = (doc.GetElement(item.Id)).GetCurve().ToProtoType()
		analytical.append(item)

		mm.append(curve)
	except:
		#typelist.append(list())
		t="no"
		
OUT = analytical
# ----------------------------------------

# group: Make a separate lists for beams and columns
filterByBoolMask_3 = List.FilterByBoolMask(list=python_script_4, mask=eq)

# group: Make a new list that has the same order than the input of the structural elements
create_3 = List.Create(filterByBoolMask_3.in, filterByBoolMask_3.out)
flatten_6 = Flatten(create_3)

# group: Get the element ids of the parent elements
python_script_5 = Python(IN[0]=flatten_6)
# ---------- python_script_5.python (27 lines) ----------
#Copyright(c) 2015, Konrad Sobon
# @arch_laboratory, http://archi-lab.net

import clr
clr.AddReference("ProtoGeometry")
from Autodesk.DesignScript.Geometry import *

# Import DocumentManager and TransactionManager
clr.AddReference("RevitServices")
import RevitServices
from RevitServices.Persistence import DocumentManager
from RevitServices.Transactions import TransactionManager

# Import RevitAPI
clr.AddReference("RevitAPI")
import Autodesk
from Autodesk.Revit.DB import *
import System
doc = DocumentManager.Instance.CurrentDBDocument

items = UnwrapElement(IN[0])

hosts=[]
for item in items:
	hosts.append(item.GetElementId())
#Assign your output to the OUT variable
OUT = hosts
# ----------------------------------------

# group: Create a column for the RevitIds
code_block_16 = CodeBlock { "RevitId"; }
addItemToFront = List.AddItemToFront(item=code_block_16, list=python_script_5)
count = Count(addItemToFront)
chop = List.Chop(addItemToFront, count)

# group: List of the beams and columns only
create_4 = List.Create(setLoad, flatten_2)
flatten_7 = Flatten(create_4)

# group: Create a column for the SAPids
code_block_17 = CodeBlock { "SAPid"; }
addItemToFront_2 = List.AddItemToFront(item=code_block_17, list=flatten_7)
count_2 = Count(addItemToFront_2)
chop_2 = List.Chop(addItemToFront_2, count_2)

# group: Create a list with the parameters names
code_block_18 = CodeBlock()
# ---------- code_block_18.designscript (12 lines) ----------
"Axial_Start";
"Shear_Major_Start";
"Shear_Minor_Start";
"Moment_Major_Start";
"Moment_Minor_Start";
"Moment_Torsion_Start";
"Axial_End";
"Shear_Major_End";
"Shear_Minor_End";
"Moment_Major_End";
"Moment_Minor_End";
"Moment_Torsion_End";
# ----------------------------------------
create_5 = List.Create(code_block_18.out0, code_block_18.out1, code_block_18.out2, code_block_18.out3, code_block_18.out4, code_block_18.out5, code_block_18.out6, code_block_18.out7, code_block_18.out8, code_block_18.out9, code_block_18.out10, code_block_18.out11)
code_block_19 = CodeBlock { 1; }
chop_3 = List.Chop(create_5, code_block_19)

# group: Get all results
forceTypes_2 = ForceTypes("Axial")
forceTypes_3 = ForceTypes("Shear22")
forceTypes_4 = ForceTypes("Shear33")
forceTypes_5 = ForceTypes("Moment33")
forceTypes_6 = ForceTypes("Moment22")
forceTypes_7 = ForceTypes("Torsion")
create_6 = List.Create(forceTypes_2, forceTypes_3, forceTypes_4, forceTypes_5, forceTypes_6, forceTypes_7)
decomposeResults_2 = DynamoSAP.Analysis.Analysis.DecomposeResults(run.out0, getResults, create_6)

count_3 = List.Count(flatten_7)

# group: Grab the results corresponding to the beams and columns only
takeItems = List.TakeItems(amount=count_3)
map = List.Map(list=decomposeResults_2, f_x=takeItems)
count_4 = Count()
map_2 = List.Map(list=map, f_x=count_4)
code_block_20 = CodeBlock { 1; }
flatten_8 = List.Flatten(list=map, amt=code_block_20)

# group: Get the forces start value
firstItem = List.FirstItem()
map_3 = List.Map(list=flatten_8, f_x=firstItem)
# note: Start values
chopByLengths = Custom[List.ChopByLengths](lengths=map_2, list=map_3)  # Turns a list into a list of lists with sublists of varying lengths.

# group: Get the forces endvalue
lastItem = List.LastItem()
map_4 = List.Map(list=flatten_8, f_x=lastItem)
# note: End values
chopByLengths_2 = Custom[List.ChopByLengths](lengths=map_2, list=map_4)

# group: Crate a column for each type of force
create_7 = List.Create()
join = List.Join(chopByLengths, chopByLengths_2)
combine = List.Combine(create_7, chop_3, join)
code_block_21 = CodeBlock { 1; }
flatten_9 = List.Flatten(amt=code_block_21)
map_5 = List.Map(list=combine, f_x=flatten_9)

# group: Make columns into rows to write to Excel
join_2 = List.Join(chop, chop_2, map_5)
transpose = List.Transpose(join_2)

watch_4 = Watch(flatten_4)
