# Dynamo graph TT_workshop_one_bay_sample.dyn (Dynamo 0.7.5.3566)

byCoordinates = Point.ByCoordinates()
length = DoubleSlider(59.216, range=0..100)
byCoordinates_2 = Point.ByCoordinates(length)
# note: Bottom line to serve as the guide for the bay
byStartPointEndPoint = Line.ByStartPointEndPoint(byCoordinates, byCoordinates_2)
number_of_divisions = IntegerSlider(4, range=2..20)
# note: Bottom curves
divideEqually = Curve.DivideEqually(byStartPointEndPoint, number_of_divisions)
# note: Plug bottom curves
startPoint = Curve.StartPoint(divideEqually)
endPoint = Curve.EndPoint(divideEqually)
lastItem = List.LastItem(endPoint)
create = List.Create(startPoint, lastItem)
# note: Column bottom points
flatten = Flatten(create)
# note: Plug column bottom points
fromPoint = DynamoSAP.Structure.Joint.FromPoint(flatten)
pinned = DynamoSAP.Definitions.Restraint.Pinned()
# note: RESTRAINTS
setRestraint = DynamoSAP.Structure.Joint.SetRestraint(fromPoint, pinned)
height = DoubleSlider(4.195, range=1..20)
byCoordinates_3 = Vector.ByCoordinates(arg2=height)
# note: Top line to serve as the guide for the bay
translate = Geometry.Translate(byStartPointEndPoint, byCoordinates_3)
# note: Top curves
divideEqually_2 = Curve.DivideEqually(translate, number_of_divisions)
# note: Plug top curves
startPoint_2 = Curve.StartPoint(divideEqually_2)
endPoint_2 = Curve.EndPoint(divideEqually_2)
lastItem_2 = List.LastItem(endPoint_2)
create_2 = List.Create(startPoint_2, lastItem_2)
# note: Column top points
flatten_2 = Flatten(create_2)
sectionCatalogs = SectionCatalogs("AISC14")
sections = DynamoSAP.Definitions.SectionProp.Sections(sectionCatalogs)
watch = Watch(sections)
integer_slider = IntegerSlider(8, range=0..100)
getItemAtIndex = List.GetItemAtIndex(watch, integer_slider)
watch_2 = Watch(getItemAtIndex)
materials = Materials("A36")
# note: SECTION PROPERTY
define = DynamoSAP.Definitions.SectionProp.Define(watch_2, materials, sectionCatalogs)
# note: COLUMN FRAMES
# note: Plug section property
fromEndPoints = DynamoSAP.Structure.Frame.FromEndPoints(flatten, flatten_2, define)
# note: BEAM FRAMES
fromEndPoints_2 = DynamoSAP.Structure.Frame.FromEndPoints(startPoint_2, endPoint_2, define)
# note: Double click and set the name to your name and _Load_Sample
string = StringInput("CORE_Load_Sample")
loadPatternTypes = LoadPatternTypes("LTYPE_DEAD")
double_slider = DoubleSlider(1.25, range=0..100)
# note: LOAD PATTERN
# note: Plug Name
setLoadPattern = DynamoSAP.Definitions.LoadPattern.SetLoadPattern(string, loadPatternTypes, double_slider)
loadType = LoadType("Force")
loadDirection = LoadDirection("b_GlobalZ")
double_slider_2 = DoubleSlider(0.177, range=0..1)
double_slider_3 = DoubleSlider(0.792, range=0..1)
double_slider_4 = DoubleSlider(-55.486, range=-100..0)
double_slider_5 = DoubleSlider(79.318, range=-100..150)
coordinateSystem = CoordinateSystem("Global")
# note: DISTRIBUTED LOAD
# note: Plug Load Pattern
distributedLoad = DynamoSAP.Definitions.Load.DistributedLoad(setLoadPattern, loadType, loadDirection, double_slider_2, double_slider_3, double_slider_4, double_slider_5, coordinateSystem)
# note: BEAM FRAMES w/LOADS
setLoad = DynamoSAP.Structure.Frame.SetLoad(fromEndPoints_2, distributedLoad)
# note: Plug
# RESTRAINTS
# COLUMN FRAMES
# BEAM FRAMES WITH LOADS
create_3 = List.Create(setRestraint, fromEndPoints, setLoad)
# note: ALL THE STRUCTURAL ELEMENTS IN THE PROJECT
flatten_3 = Flatten(create_3)
# note: Double click and set the name to your name and _LoadCase_Sample
string_2 = StringInput("CORE_LoadCase_Sample")
double_slider_6 = DoubleSlider(1.2, range=0..100)
loadCaseTypes = LoadCaseTypes("CASE_LINEAR_STATIC")
# note: LOAD CASE
setLoadCase = DynamoSAP.Definitions.LoadCase.SetLoadCase(string_2, setLoadPattern, double_slider_6, loadCaseTypes)
create_4 = List.Create(setLoadPattern, setLoadCase)
# note: ALL THE DEFINITIONS IN THE PROJECT
flatten_4 = Flatten(create_4)
# note: COLLECTOR
collector = DynamoSAP.Assembly.StructuralModel.Collector(flatten_3, flatten_4)
boolean = BoolSelector(true)
units = Units("N_m_C")
# note: TRANSLATION INTO SAP
# note: Plug structural model
toSAP = DynamoSAP.Assembly.Bake.ToSAP(collector, boolean, units)
double_slider_7 = DoubleSlider(0.859, range=0..2)
boolean_2 = BoolSelector(true)
double_slider_8 = DoubleSlider(1.019, range=0..2)
# note: DISPLAY LOADS IN DYNAMO
displayLoads = DynamoSAP.Structure.Frame.DisplayLoads(collector, arg2=double_slider_7, arg3=boolean_2, arg4=double_slider_8)
boolean_3 = BoolSelector(false)
run = DynamoSAP.Analysis.Analysis.Run(boolean_3)
watch_3 = Watch(run.out2)
integer_slider_2 = IntegerSlider(1, range=0..5)
getItemAtIndex_2 = List.GetItemAtIndex(watch_3, integer_slider_2)
watch_4 = Watch(getItemAtIndex_2)
boolean_4 = BoolSelector(true)
getResults = DynamoSAP.Analysis.Analysis.GetResults(watch_4, boolean_4)
forceTypes = ForceTypes("Moment33")
decomposeResults = DynamoSAP.Analysis.Analysis.DecomposeResults(run.out0, getResults, forceTypes)
watch_5 = Watch(decomposeResults)
double_slider_9 = DoubleSlider(1, range=0..1000)
visualizeResults = DynamoSAP.Analysis.Analysis.VisualizeResults(run.out0, getResults, forceTypes, boolean_4, double_slider_9)
decompose = DynamoSAP.Assembly.StructuralModel.Decompose(run.out0)
