# Dynamo graph TT_workshop_readRevitModel.dyn (Dynamo 0.7.5.3566)

watch_3d = Watch3D()
code_block = CodeBlock { "KN_mm_C"; }
boolean = BoolSelector(true)
get = DynamoSAP.Revit.AnalyticalModel.Get(boolean)
read = DynamoSAP.Revit.AnalyticalModel.Read(get)
define = DynamoSAP.Definitions.SectionProp.Define()
fromLine = DynamoSAP.Structure.Frame.FromLine(read, define)
collector = DynamoSAP.Assembly.StructuralModel.Collector(fromLine)
boolean_2 = BoolSelector(true)
toSAP = DynamoSAP.Assembly.Bake.ToSAP(collector, boolean_2)
