# Dynamo graph Sample_1b_SpaceStructure_withLoads.dyn (Dynamo 1.1.0.2094)

# group: Space Structure Parameters and Arcs
byCoordinates = Point.ByCoordinates()
# note: Space Frame Geometry Parameters
number_slider = DoubleSlider(6.504, range=0..100 step 0.1)
number_slider_2 = DoubleSlider(16, range=0..100 step 0.1)
number_slider_3 = DoubleSlider(10, range=0..100 step 0.1)
byCoordinates_2 = Point.ByCoordinates(x=number_slider, y=number_slider_2, z=number_slider_3)
number_slider_4 = DoubleSlider(16, range=0..100 step 0.1)
number_slider_5 = DoubleSlider(50, range=0..100 step 0.1)
byCoordinates_3 = Point.ByCoordinates(x=number_slider_4, y=number_slider_5)
byThreePoints = Arc.ByThreePoints(firstPoint=byCoordinates, secondPoint=byCoordinates_2, thirdPoint=byCoordinates_3)
number_slider_6 = DoubleSlider(-5, range=-10..100 step 0.1)
byCoordinates_4 = Point.ByCoordinates(x=number_slider_6)
number_slider_7 = DoubleSlider(15, range=0..100 step 0.1)
number_slider_8 = DoubleSlider(10, range=0..100 step 0.1)
byCoordinates_5 = Point.ByCoordinates(x=number_slider_6, y=number_slider_7, z=number_slider_8)
number_slider_9 = DoubleSlider(50, range=0..100 step 0.1)
byCoordinates_6 = Point.ByCoordinates(x=number_slider_6, y=number_slider_9)
byThreePoints_2 = Arc.ByThreePoints(firstPoint=byCoordinates_4, secondPoint=byCoordinates_5, thirdPoint=byCoordinates_6)
create = List.Create(byThreePoints, byThreePoints_2)

# group: Space Structure Geometry
byLoft = Surface.ByLoft(create)
integer_slider = IntegerSlider(4, range=0..100 step 1)
integer_slider_2 = IntegerSlider(5, range=0..100 step 1)
wireSpaceTruss = Custom[LunchBox Space Truss Structure](Surface=byLoft, U=integer_slider, V=integer_slider, Depth=integer_slider_2)  # Create a space truss using a surface.
create_2 = List.Create(wireSpaceTruss.CenterlinesA, wireSpaceTruss.CenterlinesB, wireSpaceTruss.CenterlinesD, wireSpaceTruss.CenterlinesE)
flatten = Flatten(create_2)

# group: Define Sections
sectionCatalogs = SectionCatalogs("AISC14")
sections = DynamoSAP.Definitions.SectionProp.Sections(sectionCatalogs)
# note: Get Sections Names from given Section Catalog (Make sure SAP Model is Open )
code_block = CodeBlock(x=sections) { x[1001]; }
section_name = Watch(code_block)
materials = Materials("A36")
define = DynamoSAP.Definitions.SectionProp.Define(section_name, materials, sectionCatalogs)

# group: Define Frame from Line
fromLine = DynamoSAP.Structure.Frame.FromLine(flatten, define)
fromLine_2 = DynamoSAP.Structure.Frame.FromLine(wireSpaceTruss.CenterlinesC, define)

loadPatternTypes = LoadPatternTypes("Dead")

# group: Create a Distributed Load
string = StringInput("MyLoadPattern")
number_slider_10 = DoubleSlider(1.25, range=0..2 step 0.1)
# note: Create a Load Pattern.
setLoadPattern = DynamoSAP.Definitions.LoadPattern.SetLoadPattern(string, loadPatternTypes, number_slider_10)
loadType = LoadType("Force")
loadDirection = LoadDirection("b_GlobalZ")
number_slider_11 = DoubleSlider(0.1, range=0..1 step 0.1)
number_slider_12 = DoubleSlider(1, range=0..1 step 0.1)
number_slider_13 = DoubleSlider(-50, range=-100..100 step 0.1)
coordinateSystem = CoordinateSystem("Global")
# note: Create a Load. This can be a Point Load or a Distributed Load
distributedLoad = DynamoSAP.Definitions.Load.DistributedLoad(setLoadPattern, loadType, loadDirection, number_slider_11, number_slider_12, number_slider_13, number_slider_13, coordinateSystem)

# note: Define Loads for some of the frames
setLoad = DynamoSAP.Structure.Frame.SetLoad(fromLine_2, distributedLoad)
# note: Make sure you flatten the list of Structural Elements to be fed into the collector
create_3 = List.Create(fromLine, setLoad)
flatten_2 = Flatten(create_3)
create_4 = List.Create(setLoadPattern)
flatten_3 = Flatten(create_4)
# note: Collector for Structural Model with Definitions
collector = DynamoSAP.Assembly.StructuralModel.Collector(flatten_2, flatten_3)
number_slider_14 = DoubleSlider(0.5, range=0..100 step 0.1)
boolean = BoolSelector(false)
# note: Display Loads in Dynamo
displayLoads = DynamoSAP.Structure.Frame.DisplayLoads(collector, arg2=number_slider_14, arg3=boolean)
boolean_2 = BoolSelector(true)
units = Units("lb_in_F")
# note: Bake to SAP model! set Delete true if you like overwrite the existing model.
toSAP = DynamoSAP.Assembly.Bake.ToSAP(collector, boolean_2, units)
# note: DeCompose Structural Model _ Confirm
decompose = DynamoSAP.Assembly.StructuralModel.Decompose(toSAP)
