# Dynamo graph Sample_2a_Read_Dome+DecomposeSapModel.dyn (Dynamo 1.1.0.2094)

# note: OR Browse existing Simple Shell Structure SAP Model
SAPModel = DynamoSAP.Assembly.Read.SAPModel()
file_path = Filename("No file selected.")
boolean = BoolSelector(true)
boolean_2 = BoolSelector(true)
# note: Grabs open SAP instance
SAPModel_2 = DynamoSAP.Assembly.Read.SAPModel(boolean_2)
# note: Decompose Structural Model
decompose = DynamoSAP.Assembly.StructuralModel.Decompose(SAPModel_2)
# note: Decompose Frame
decompose_2 = DynamoSAP.Structure.Frame.Decompose(decompose)
# note: Decompose Section Property
decompose_3 = DynamoSAP.Definitions.SectionProp.Decompose(decompose_2.out1)
