# Dynamo graph Sample_4b_Read_Edit_AddLoadCase.dyn (Dynamo 0.8.0.950)

# note: Set boolean to True to run the analysis on SAP
# note: Open the sample file supplied 3a_RunAnalysis.sdb in SAP
boolean = BoolSelector(true)
# note: Get the structural elements and definitions in the model
SAPModel = DynamoSAP.Assembly.Read.SAPModel(boolean)
# note: Use Structural Model.Decompose to preview the geometry of the structural members
decompose = DynamoSAP.Assembly.StructuralModel.Decompose(SAPModel.out0)
# note: Decompose the frames to get their base curves
decompose_2 = DynamoSAP.Structure.Frame.Decompose(decompose.out0)
code_block = CodeBlock { "DynamoSAP_DeadLoadPattern"; }
loadPatternTypes = LoadPatternTypes("LTYPE_DEAD")
number_slider = DoubleSlider(1.1, range=0..100 step 0.1)
# note: Create Load Pattern
setLoadPattern = DynamoSAP.Definitions.LoadPattern.SetLoadPattern(code_block, loadPatternTypes, number_slider)
code_block_2 = CodeBlock { "DynamoSAP_LiveLoadPattern"; }
loadPatternTypes_2 = LoadPatternTypes("LTYPE_LIVE")
number_slider_2 = DoubleSlider(1.3, range=0..100 step 0.1)
setLoadPattern_2 = DynamoSAP.Definitions.LoadPattern.SetLoadPattern(code_block_2, loadPatternTypes_2, number_slider_2)
code_block_3 = CodeBlock { "DynamoSAP_LoadCase"; }
create = List.Create(setLoadPattern, setLoadPattern_2)
number_slider_3 = DoubleSlider(1.25, range=0..100 step 0.1)
number_slider_4 = DoubleSlider(1.5, range=0..100 step 0.1)
# note: Provide the same number of scale factors as that of the load patterns
create_2 = List.Create(number_slider_3, number_slider_4)
loadCaseTypes = LoadCaseTypes("CASE_LINEAR_STATIC")
# note: Create Load Case
setLoadCase = DynamoSAP.Definitions.LoadCase.SetLoadCase(code_block_3, create, create_2, loadCaseTypes)
# note: Gather the existing and the new definitions (the new load case and load patterns in this case)
create_3 = List.Create(decompose.out3, decompose.out4, setLoadPattern, setLoadPattern_2, setLoadCase)
flatten = Flatten(create_3)
# note: Collect the structural members and the definitions
collector = DynamoSAP.Assembly.StructuralModel.Collector(decompose.out0, flatten)
boolean_2 = BoolSelector(true)
# note: Bake to SAP
# note: Set the boolean to true to update your model in SAP and connect structural model
toSAP = DynamoSAP.Assembly.Bake.ToSAP(collector, boolean_2, SAPModel.out1)
# note: Check how the load cases and load patterns were sucessfully updated in the SAP model
decompose_3 = DynamoSAP.Assembly.StructuralModel.Decompose(toSAP)
decompose_4 = DynamoSAP.Definitions.LoadCase.Decompose(decompose_3.out4)
decompose_5 = DynamoSAP.Definitions.LoadPattern.Decompose(decompose_3.out3)
