# Dynamo graph Sample_5a_RevitToSap.dyn (Dynamo 0.8.1.1942)

# note: Select elements and their analytical model
select_model_elements = DSModelElementsSelection()  # 16 picked in the model
# note: This will read the analytical model elements
python_script = Python(IN[0]=select_model_elements)
# ---------- python_script.python (30 lines) ----------
import clr
clr.AddReference('RevitAPI')
from Autodesk.Revit.DB import *
from Autodesk.Revit.DB import Structure

clr.AddReference("RevitServices")
import RevitServices
from RevitServices.Persistence import DocumentManager

clr.AddReference("RevitNodes")
import Revit
clr.ImportExtensions(Revit.GeometryConversion)

doc = DocumentManager.Instance.CurrentDBDocument
items = UnwrapElement(IN[0])
typelist = list()
mm = list()
for item in items:
	try: 
		typelist.append(doc.GetElement(item.Id))
		
		startPoint = (doc.GetElement(item.Id)).GetCurve().ToProtoType()
		

		mm.append(startPoint)
	except:
		#typelist.append(list())
		t="no"
		
OUT = mm
# ----------------------------------------
# note: Get the section names
name = Family.Name(select_model_elements)
# note: Remove empty elements
python_script_2 = Python(IN[0]=name)
# ---------- python_script_2.python (22 lines) ----------
import clr
clr.AddReference('RevitAPI')
from Autodesk.Revit.DB import *
from Autodesk.Revit.DB import Structure

clr.AddReference("RevitServices")
import RevitServices
from RevitServices.Persistence import DocumentManager

clr.AddReference("RevitNodes")
import Revit
clr.ImportExtensions(Revit.GeometryConversion)

doc = DocumentManager.Instance.CurrentDBDocument
items = UnwrapElement(IN[0])
typelist = list()
mm = list()
for item in items:
	if (item != ""):
		mm.append(item)
		
OUT = mm
# ----------------------------------------
# note: Select the catalog to get the sections from
sectionCatalogs = SectionCatalogs("AISC14")
# note: Define the sections
define = DynamoSAP.Definitions.SectionProp.Define(python_script_2, arg2=sectionCatalogs)
code_block = CodeBlock { "Cross-Section Rotation"; }
getParameterValueByName = Element.GetParameterValueByName(element=select_model_elements, parameterName=code_block)
categories = Categories("StructuralColumns")
# note: Get angles and if the elements are columns
python_script_3 = Python(IN[0]=name, IN[1]=getParameterValueByName, IN[2]=select_model_elements, IN[3]=categories)
# ---------- python_script_3.python (31 lines) ----------
import clr
clr.AddReference('RevitAPI')
from Autodesk.Revit.DB import *
from Autodesk.Revit.DB import Structure

clr.AddReference("RevitServices")
import RevitServices
from RevitServices.Persistence import DocumentManager

clr.AddReference("RevitNodes")
import Revit
clr.ImportExtensions(Revit.GeometryConversion)

doc = DocumentManager.Instance.CurrentDBDocument
items = UnwrapElement(IN[0])
angles = IN[1]
elements = UnwrapElement(IN[2])
cat = UnwrapElement(IN[3])
rotationList = list()
booleanList = list()

for i in range(0,len(items)):
	if (items[i] == ""):
		rotationList.append(angles[i])
	else:
		if elements[i].Category.Id==cat.Id:
			booleanList.append(True)
		else:
			booleanList.append(False)
		
OUT = (rotationList,booleanList)
# ----------------------------------------
rotationAngles = List.FirstItem(python_script_3)
isColumn = List.LastItem(python_script_3)
revitToSAPRotationMapper = DynamoSAP.Structure.Frame.RevitToSAPRotationMapper(rotationAngles, isColumn)
# note: Create frame from lines
fromLine = DynamoSAP.Structure.Frame.FromLine(python_script, define, arg3=revitToSAPRotationMapper)
# note: Create a DYNAMOSAP structural model
collector = DynamoSAP.Assembly.StructuralModel.Collector(fromLine)
boolean = BoolSelector(true)
# note: Bake to SAP
toSAP = DynamoSAP.Assembly.Bake.ToSAP(collector, boolean)
sections = DynamoSAP.Definitions.SectionProp.Sections(sectionCatalogs)
