# Dynamo graph CaseStudy_2_Prototype.dyn (Dynamo 0.7.2.2921)

byCoordinates = Point.ByCoordinates()
double_slider = DoubleSlider(30, range=0..100)
double_slider_2 = DoubleSlider(50, range=0..100)
byCoordinates_2 = Point.ByCoordinates(double_slider, double_slider_2)
fromEndPoints = DynamoSAP.Structure.Frame.FromEndPoints(byCoordinates, byCoordinates_2)
guid = DynamoSAP.Structure.Frame.guid(fromEndPoints)
code_block = CodeBlock { "testLP_dead"; }
loadPatternTypeDropDown = LoadPatternTypeDropDown("LTYPE_DEAD")
setLoadPattern = DynamoSAP.Analysis.LoadPattern.SetLoadPattern(code_block, loadPatternTypeDropDown)
number = DoubleInput(1)
number_2 = DoubleInput(5)
number_3 = DoubleInput(0.3)
number_4 = DoubleInput(50)
pointLoadOnFrame = DynamoSAP.Analysis.Load.PointLoadOnFrame(fromEndPoints, setLoadPattern, number, number_2, number_3, number_4)
frame = DynamoSAP.Analysis.Load.Frame(pointLoadOnFrame)
guid_2 = DynamoSAP.Structure.Frame.guid(frame)
