# Dynamo graph Frame testing.dyn (Dynamo 0.7.6.3382)

byCoordinates = Point.ByCoordinates()
code_block = CodeBlock { 5; }
byCoordinates_2 = Point.ByCoordinates(arg2=code_block)
define = DynamoSAP.Structure.SectionProp.Define()
fromEndPoints = DynamoSAP.Structure.Frame.FromEndPoints(byCoordinates, byCoordinates_2, define)
decompose = DynamoSAP.Structure.Frame.Decompose(fromEndPoints)
boolean = BoolSelector(true)
set = DynamoSAP.Structure.Release.Set(arg3=boolean)
setReleases = DynamoSAP.Structure.Frame.SetReleases(fromEndPoints, set)
decompose_2 = DynamoSAP.Structure.Frame.Decompose(setReleases)
boolean_2 = BoolSelector(false)
code_block_2 = CodeBlock { "Frame_loadp"; }
loadPatternTypeDropDown = LoadPatternTypeDropDown("LTYPE_DEAD")
setLoadPattern = DynamoSAP.Structure.LoadPattern.SetLoadPattern(code_block_2, loadPatternTypeDropDown)
code_block_3 = CodeBlock { 1; }
code_block_4 = CodeBlock { 4; }
code_block_5 = CodeBlock { 0.5; }
code_block_6 = CodeBlock { 1; }
code_block_7 = CodeBlock { 10; }
distributedLoadOnFrame = DynamoSAP.Structure.Load.DistributedLoadOnFrame(setLoadPattern, code_block_3, code_block_4, code_block_5, code_block_6, code_block_7, code_block_7)
setLoad = DynamoSAP.Structure.Frame.SetLoad(fromEndPoints, distributedLoadOnFrame)
decompose_3 = DynamoSAP.Structure.Frame.Decompose(setLoad)
pointLoadOnFrame = DynamoSAP.Structure.Load.PointLoadOnFrame(setLoadPattern, code_block_3, code_block_4, code_block_5, code_block_7)
setLoad_2 = DynamoSAP.Structure.Frame.SetLoad(setReleases, pointLoadOnFrame)
displayLoads = DynamoSAP.Structure.Frame.DisplayLoads(setLoad_2)
boolean_3 = BoolSelector(false)
runOpenInstance = DynamoSAP.Analysis.Analysis.RunOpenInstance(boolean_3)
boolean_4 = BoolSelector(true)
code_block_8 = CodeBlock { "C:\Users\AGarciaPuyol\Documents\DynamoSAP\DynamoSAP_20141208.sdb"; }
runFromFile = DynamoSAP.Analysis.Analysis.RunFromFile(boolean_4, code_block_8)
integer_slider = IntegerSlider(3, range=0..100)
getItemAtIndex = List.GetItemAtIndex(runFromFile.out1, integer_slider)
getResults = DynamoSAP.Analysis.Analysis.GetResults(getItemAtIndex, boolean_4)
forceTypeDropDown = ForceTypeDropdown("Axial")
decomposeResults = DynamoSAP.Analysis.Analysis.DecomposeResults(runFromFile.out0, getResults, forceTypeDropDown)
create = List.Create(setReleases)
code_block_9 = CodeBlock { "My load case"; }
code_block_10 = CodeBlock { 1.2; }
loadCaseTypeDropDown = LoadCaseTypeDropDown("CASE_LINEAR_STATIC")
setLoadCase = DynamoSAP.Structure.LoadCase.SetLoadCase(code_block_9, setLoadPattern, code_block_10, loadCaseTypeDropDown)
fixed = DynamoSAP.Structure.Restraint.Fixed(byCoordinates)
collector = DynamoSAP.Assembly.StructuralModel.Collector(create, setLoadPattern, setLoadCase, fixed)
boolean_5 = BoolSelector(false)
toSAP = DynamoSAP.Assembly.Bake.ToSAP(collector, boolean_5)
code_block_11 = CodeBlock { 200; }
visualizeResults = DynamoSAP.Analysis.Analysis.VisualizeResults(toSAP, getResults, forceTypeDropDown, code_block_11)
setLoad_3 = DynamoSAP.Structure.Frame.SetLoad(setReleases, pointLoadOnFrame)
decompose_4 = DynamoSAP.Structure.Frame.Decompose(setLoad_3)
