# Dynamo graph GroupTest.dyn (Dynamo 0.7.5.3566)

coordinateSystem = CoordinateSystem("Local")
loadType = LoadType("Moment")
watch = Watch(loadType)
boolean = BoolSelector(true)
SAPModel = DynamoSAP.Assembly.Read.SAPModel(boolean)
decompose = DynamoSAP.Assembly.StructuralModel.Decompose(SAPModel)
decompose_2 = DynamoSAP.Definitions.Group.Decompose(decompose.out6)
decompose_3 = DynamoSAP.Definitions.LoadCase.Decompose(decompose.out4)
decompose_4 = DynamoSAP.Definitions.LoadPattern.Decompose(decompose.out3)
decompose_5 = DynamoSAP.Definitions.LoadCombo.Decompose(decompose.out5)
