# Dynamo graph Mesh test.dyn (Dynamo 0.7.6.3423)

byCoordinates = Point.ByCoordinates()
code_block = CodeBlock { 5; }
byCoordinates_2 = Point.ByCoordinates(arg1=code_block)
byCoordinates_3 = Point.ByCoordinates(code_block, code_block)
byCoordinates_4 = Point.ByCoordinates(code_block)
create = List.Create(byCoordinates, byCoordinates_2, byCoordinates_3, byCoordinates_4)
code_block_2 = CodeBlock { 10; }
byCoordinates_5 = Point.ByCoordinates(code_block_2)
create_2 = List.Create(byCoordinates_5, byCoordinates_4, byCoordinates_3)
create_3 = List.Create(create, create_2)
flatten = Flatten(create_3)
code_block_3 = CodeBlock { 0; }
code_block_4 = CodeBlock { 1; }
code_block_5 = CodeBlock { 2; }
code_block_6 = CodeBlock { 3; }
byIndices = IndexGroup.ByIndices(code_block_3, code_block_4, code_block_5, code_block_6)
byIndices_2 = IndexGroup.ByIndices(code_block_3, code_block_4, code_block_5)
create_4 = List.Create(byIndices, byIndices_2)
flatten_2 = Flatten(create_4)
code_block_7 = CodeBlock { 1; }
chop = List.Chop(create_4, code_block_7)
byPointsFaceIndices = Mesh.ByPointsFaceIndices(create_3, chop)
faceVertices = Custom[Mesh.FaceVertices](Mesh=byPointsFaceIndices)  # Gets the vertices of each face of a given mesh
vertexPositions = Mesh.VertexPositions(byPointsFaceIndices)
