# Dynamo graph Prototype blocks.dyn (Dynamo 0.7.2.2921)

FRAME = Formula("Curve + Material+ Section + Justification+Rotation")
load_case = Formula("pattern+loadName", FRAME)
load_pattern = Formula("Name + Type + Multiplier")
distributed_load = Formula("Frame+direction+amount+pattern", Frame=FRAME, pattern=load_pattern)
code_block = CodeBlock { "Vector as Vector3d"; }
POINTLOADONFRAME = Formula("frame+t+vector+amount+pattern", FRAME, arg2=code_block)
LOADS = List.Create(distributed_load, POINTLOADONFRAME)
restraints = Formula("XX+YY+ZZ")
COLLECTOR = Formula("Frame+loadcase+Loads+restraints", Frame=FRAME, loadcase=load_case, Loads=LOADS, restraints=restraints)
