# Dynamo graph ReadSapModel.dyn (Dynamo 0.7.4.3192)

file_path = Filename("C:\Users\EErtugrul\Desktop\Wimbledon\2014-11-21-Master Model.sdb")
boolean = BoolSelector(true)
SAPModel = DynamoSAP.Assembly.Read.SAPModel(file_path, boolean)
frames = DynamoSAP.Assembly.StructuralModel.Frames(SAPModel)
baseCurve = DynamoSAP.Structure.Frame.BaseCurve(frames)
