# Dynamo graph RevitStructuresToDynamo_bh_001.dyn (Dynamo 0.7.2.10743)

code_block = CodeBlock { "Revit > Dynamo"; }
code_block_2 = CodeBlock()
# ---------- code_block_2.designscript (3 lines) ----------
//Select Revit Elements
//or a Filter on the doc;
1123;
# ----------------------------------------
getAnalyticalModel = CodeBlock(elem=code_block_2)
# ---------- getAnalyticalModel.designscript (3 lines) ----------
//get the analytical
//model from an element;
elem;
# ----------------------------------------
decomposeAnalyticalModel = CodeBlock(AnalyticalModel=getAnalyticalModel)
# ---------- decomposeAnalyticalModel.designscript (7 lines) ----------
//decompose analytical model
AnalyticalModel;
"Curves";
"ParentElement";
"momentForces";
"shearForces";
"etc";
# ----------------------------------------
analyticalModelToFrame = CodeBlock(AnalyticalModel=decomposeAnalyticalModel.AnalyticalModel)
# ---------- analyticalModelToFrame.designscript (3 lines) ----------
//convert analytical model
//to sap frame
Frame = AnalyticalModel;
# ----------------------------------------
loadsFromAnalyticalModel = CodeBlock(AnalyticalModel=getAnalyticalModel)
# ---------- loadsFromAnalyticalModel.designscript (3 lines) ----------
//get loads on an
//analytical model
Loads = AnalyticalModel;
# ----------------------------------------
loadsDocumentFilter = CodeBlock()
# ---------- loadsDocumentFilter.designscript (2 lines) ----------
//get loads from project;
"Loads";
# ----------------------------------------
create = List.Create(loadsFromAnalyticalModel, loadsDocumentFilter)
decomposeLoad = CodeBlock(Load=create)
# ---------- decomposeLoad.designscript (6 lines) ----------
//decompose a load
Load;
"ParentAnalyticalModel";
"Load Type";
"Load Case";
"Forces";
# ----------------------------------------
revitLoadToSapLoad = CodeBlock(RevitLoad=decomposeLoad.Load)
# ---------- revitLoadToSapLoad.designscript (3 lines) ----------
//convert revit load
//to sap load
SAPload = RevitLoad;
# ----------------------------------------
supportsFromAnalyticalModel = CodeBlock(AnalyticalModel=getAnalyticalModel)
# ---------- supportsFromAnalyticalModel.designscript (3 lines) ----------
//get supprts from an
//analytical model;
Supports = AnalyticalModel;
# ----------------------------------------
decomposeSupport = CodeBlock(Support=supportsFromAnalyticalModel)
# ---------- decomposeSupport.designscript (11 lines) ----------
//decompose a support
Support;
"ParentAnalyticalModel";
"OrientTo";
"state";
"X translation";
"Y translation";
"Z translation";
"X rotation";
"Y rotation";
"Z rotation";
# ----------------------------------------
supportToRestraint = CodeBlock(support=decomposeSupport.Support)
# ---------- supportToRestraint.designscript (3 lines) ----------
//convert revit load
//to sap load
restraint = support;
# ----------------------------------------
supportsDocumentFilter = CodeBlock()
# ---------- supportsDocumentFilter.designscript (2 lines) ----------
//get supports from project;
"Supports";
# ----------------------------------------
loadCasesDocumentFilter = CodeBlock()
# ---------- loadCasesDocumentFilter.designscript (2 lines) ----------
//get load cases from project;
"LoadCase";
# ----------------------------------------
loadCombosDocumentFilter = CodeBlock()
# ---------- loadCombosDocumentFilter.designscript (2 lines) ----------
//get load combinations from project;
"LoadCombos";
# ----------------------------------------
decomposeLoadCombo = CodeBlock(LoadCombo=loadCombosDocumentFilter)
# ---------- decomposeLoadCombo.designscript (5 lines) ----------
//decompose load combo
LoadCombo;
"LoadCases";
"Factors";
"etc";
# ----------------------------------------
create_2 = List.Create(loadCasesDocumentFilter, decomposeLoadCombo.out1)
decomposeLoadCase = CodeBlock(LoadCase=create_2)
# ---------- decomposeLoadCase.designscript (6 lines) ----------
//decompose load case
LoadCase;
"Name";
"Number";
"Nature";
"Category";
# ----------------------------------------
loadCaseToLoadPattern = CodeBlock(LoadCase=decomposeLoadCase.LoadCase)
# ---------- loadCaseToLoadPattern.designscript (3 lines) ----------
//convert revit load case
//into SAP load pattern
LoadPattern = LoadCase;
# ----------------------------------------
rvtLoadComboToSapLoadCombo = CodeBlock(RvtLoadCombo=decomposeLoadCombo.LoadCombo)
# ---------- rvtLoadComboToSapLoadCombo.designscript (3 lines) ----------
//convert revit load combo
//into SAP load combo
SAPloadCombo = RvtLoadCombo;
# ----------------------------------------
