# Dynamo graph Sample_1_SpaceStructure.dyn (Dynamo 0.7.5.3566)

byCoordinates = Point.ByCoordinates()
double_slider = DoubleSlider(6.504, range=0..100)
double_slider_2 = DoubleSlider(15, range=0..100)
double_slider_3 = DoubleSlider(10, range=0..100)
byCoordinates_2 = Point.ByCoordinates(double_slider, double_slider_2, double_slider_3)
double_slider_4 = DoubleSlider(16, range=0..100)
double_slider_5 = DoubleSlider(50, range=0..100)
byCoordinates_3 = Point.ByCoordinates(double_slider_4, double_slider_5)
byThreePoints = Arc.ByThreePoints(byCoordinates, byCoordinates_2, byCoordinates_3)
double_slider_6 = DoubleSlider(-5, range=-10..100)
byCoordinates_4 = Point.ByCoordinates(double_slider_6)
double_slider_7 = DoubleSlider(15, range=0..100)
double_slider_8 = DoubleSlider(10, range=0..100)
byCoordinates_5 = Point.ByCoordinates(double_slider_6, double_slider_7, double_slider_8)
double_slider_9 = DoubleSlider(50, range=0..100)
byCoordinates_6 = Point.ByCoordinates(double_slider_6, double_slider_9)
byThreePoints_2 = Arc.ByThreePoints(byCoordinates_4, byCoordinates_5, byCoordinates_6)
create = List.Create(byThreePoints, byThreePoints_2)
byLoft = Surface.ByLoft(create)
integer_slider = IntegerSlider(4, range=0..100)
integer_slider_2 = IntegerSlider(5, range=0..100)
# note: Geometry
lunchbox_space_truss_structure = Custom[LunchBox Space Truss Structure](Surface=byLoft, U=integer_slider, V=integer_slider, Depth=integer_slider_2)  # Create a space truss using a surface.
create_2 = List.Create(lunchbox_space_truss_structure.CenterlinesA, lunchbox_space_truss_structure.CenterlinesB, lunchbox_space_truss_structure.CenterlinesC, lunchbox_space_truss_structure.CenterlinesD, lunchbox_space_truss_structure.CenterlinesE)
flatten = Flatten(create_2)
sectionCatalogs = SectionCatalogs("AISC14")
sections = DynamoSAP.Definitions.SectionProp.Sections(sectionCatalogs)
code_block = CodeBlock(x=sections) { x[1902]; }
# note: SectionProp
materials = Materials("A36")
define = DynamoSAP.Definitions.SectionProp.Define(code_block, materials, sectionCatalogs)
# note: Frame
fromLine = DynamoSAP.Structure.Frame.FromLine(flatten, define)
collector = DynamoSAP.Assembly.StructuralModel.Collector(fromLine)
boolean = BoolSelector(true)
units = Units("kN_m_C")
toSAP = DynamoSAP.Assembly.Bake.ToSAP(collector, boolean, units)
