# Dynamo graph Sample_1b_SpaceStructure_withLoads.dyn (Dynamo 0.7.5.3566)

byCoordinates = Point.ByCoordinates()
double_slider = DoubleSlider(6.504, range=0..100)
double_slider_2 = DoubleSlider(15, range=0..100)
double_slider_3 = DoubleSlider(10, range=0..100)
byCoordinates_2 = Point.ByCoordinates(double_slider, double_slider_2, double_slider_3)
double_slider_4 = DoubleSlider(16, range=0..100)
double_slider_5 = DoubleSlider(50, range=0..100)
byCoordinates_3 = Point.ByCoordinates(double_slider_4, double_slider_5)
byThreePoints = Arc.ByThreePoints(byCoordinates, byCoordinates_2, byCoordinates_3)
double_slider_6 = DoubleSlider(-5, range=-10..100)
byCoordinates_4 = Point.ByCoordinates(double_slider_6)
double_slider_7 = DoubleSlider(15, range=0..100)
double_slider_8 = DoubleSlider(10, range=0..100)
byCoordinates_5 = Point.ByCoordinates(double_slider_6, double_slider_7, double_slider_8)
double_slider_9 = DoubleSlider(50, range=0..100)
byCoordinates_6 = Point.ByCoordinates(double_slider_6, double_slider_9)
byThreePoints_2 = Arc.ByThreePoints(byCoordinates_4, byCoordinates_5, byCoordinates_6)
create = List.Create(byThreePoints, byThreePoints_2)
byLoft = Surface.ByLoft(create)
integer_slider = IntegerSlider(6, range=0..100)
integer_slider_2 = IntegerSlider(6, range=0..100)
lunchbox_diamond_grid_by_face = Custom[LunchBox Diamond Grid by Face](Surface=byLoft, U=integer_slider, V=integer_slider_2)  # Create a Diamond XYZ grid on a face. The face surface must have an untrimmed UV parameter space.
code_block = CodeBlock { "MyShellProperties"; }
shellTypes = ShellTypes("Membrane")
define = DynamoSAP.Definitions.ShellProp.Define(code_block, shellTypes)
fromSurface = DynamoSAP.Structure.Shell.FromSurface(lunchbox_diamond_grid_by_face.B_Panels_Faces, define)
fromSurface_2 = DynamoSAP.Structure.Shell.FromSurface(lunchbox_diamond_grid_by_face.A_Panel_Faces, define)
create_2 = List.Create(fromSurface, fromSurface_2)
flatten = Flatten(create_2)
collector = DynamoSAP.Assembly.StructuralModel.Collector(flatten)
boolean = BoolSelector(true)
units = Units("kN_m_C")
toSAP = DynamoSAP.Assembly.Bake.ToSAP(collector, boolean, units)
code_block_2 = CodeBlock { "MyLoadCase"; }
code_block_3 = CodeBlock { "MyLoadPattern"; }
loadPatternTypes = LoadPatternTypes("LTYPE_DEAD")
double_slider_10 = DoubleSlider(0.75, range=0..5)
setLoadPattern = DynamoSAP.Definitions.LoadPattern.SetLoadPattern(code_block_3, loadPatternTypes, double_slider_10)
double_slider_11 = DoubleSlider(1.5, range=0..4)
loadCaseTypes = LoadCaseTypes("CASE_LINEAR_STATIC")
setLoadCase = DynamoSAP.Definitions.LoadCase.SetLoadCase(code_block_2, setLoadPattern, double_slider_11, loadCaseTypes)
integer_slider_3 = IntegerSlider(1, range=0..100)
integer_slider_4 = IntegerSlider(3, range=0..100)
double_slider_12 = DoubleSlider(0.5, range=0..100)
double_slider_13 = DoubleSlider(120, range=0..120)
pointLoadOnFrame = DynamoSAP.Definitions.Load.PointLoadOnFrame(setLoadPattern, integer_slider_3, integer_slider_4, double_slider_12, double_slider_13)
integer_slider_5 = IntegerSlider(4, range=0..100)
integer_slider_6 = IntegerSlider(5, range=0..100)
# note: Geometry
lunchbox_space_truss_structure = Custom[LunchBox Space Truss Structure](U=integer_slider_5, V=integer_slider_5, Depth=integer_slider_6)  # Create a space truss using a surface.
create_3 = List.Create(lunchbox_space_truss_structure.CenterlinesA, lunchbox_space_truss_structure.CenterlinesB, lunchbox_space_truss_structure.CenterlinesC, lunchbox_space_truss_structure.CenterlinesD)
flatten_2 = Flatten(create_3)
sectionCatalogs = SectionCatalogs("AISC14")
sections = DynamoSAP.Definitions.SectionProp.Sections(sectionCatalogs)
code_block_4 = CodeBlock(x=sections) { x[1902]; }
materials = Materials("A36")
# note: SectionProp
define_2 = DynamoSAP.Definitions.SectionProp.Define(code_block_4, materials, sectionCatalogs)
# note: Frame
fromLine = DynamoSAP.Structure.Frame.FromLine(flatten_2, define_2)
create_4 = List.Create(lunchbox_space_truss_structure.CenterlinesE)
fromLine_2 = DynamoSAP.Structure.Frame.FromLine(create_4, define_2)
double_slider_14 = DoubleSlider(0.2, range=0..100)
double_slider_15 = DoubleSlider(0.75, range=0..100)
code_block_5 = CodeBlock { "Local"; }
distributedLoadOnFrame = DynamoSAP.Definitions.Load.DistributedLoadOnFrame(setLoadPattern, integer_slider_3, integer_slider_4, double_slider_14, double_slider_15, double_slider_13, double_slider_13, code_block_5)
setLoad = DynamoSAP.Structure.Frame.SetLoad(fromLine_2, distributedLoadOnFrame)
create_5 = List.Create(byCoordinates, byCoordinates_3, byCoordinates_4, byCoordinates_6)
fromPoint = DynamoSAP.Structure.Joint.FromPoint(create_5)
pinned = DynamoSAP.Definitions.Restraint.Pinned()
setRestraint = DynamoSAP.Structure.Joint.SetRestraint(fromPoint, pinned)
create_6 = List.Create(fromLine, setLoad, setRestraint)
flatten_3 = Flatten(create_6)
collector_2 = DynamoSAP.Assembly.StructuralModel.Collector(flatten_3)
boolean_2 = BoolSelector(true)
displayLoads = DynamoSAP.Structure.Frame.DisplayLoads(collector_2, code_block_3, arg3=boolean_2)
boolean_3 = BoolSelector(false)
run = DynamoSAP.Analysis.Analysis.Run(boolean_3)
code_block_6 = CodeBlock { 2; }
getItemAtIndex = List.GetItemAtIndex(run.out1, code_block_6)
boolean_4 = BoolSelector(true)
getResults = DynamoSAP.Analysis.Analysis.GetResults(getItemAtIndex, boolean_4)
forceTypes = ForceTypes("Torsion")
decomposeResults = DynamoSAP.Analysis.Analysis.DecomposeResults(run.out0, getResults, forceTypes)
double_slider_16 = DoubleSlider(0.2, range=0..30)
visualizeResults = DynamoSAP.Analysis.Analysis.VisualizeResults(run.out0, getResults, forceTypes, boolean_4, double_slider_16)
setRestraint_2 = DynamoSAP.Structure.Joint.SetRestraint(fromPoint, pinned)
fromSurface_3 = DynamoSAP.Structure.Shell.FromSurface(lunchbox_diamond_grid_by_face.A_Panel_Faces, define)
