# Dynamo graph Sample_2a_Read+DecomposeSapModel.dyn (Dynamo 0.7.5.3566)

file_path = Filename("C:\Users\EErtugrul\Desktop\Wimbledon\2014-11-21-Master Model.sdb")
boolean = BoolSelector(true)
SAPModel = DynamoSAP.Assembly.Read.SAPModel(file_path, boolean)
decompose = DynamoSAP.Assembly.StructuralModel.Decompose(SAPModel)
baseCurve = DynamoSAP.Structure.Frame.BaseCurve(decompose)
