# Dynamo graph Sample_2a_Read_Dome+DecomposeSapModel - Copy.dyn (Dynamo 0.7.5.3566)

# note: OR Browse existing Simple Shell Structure SAP Model
SAPModel = DynamoSAP.Assembly.Read.SAPModel()
file_path = Filename("\n      ")
boolean = BoolSelector(true)
boolean_2 = BoolSelector(true)
# note: Grabs open SAP instance
SAPModel_2 = DynamoSAP.Assembly.Read.SAPModel(boolean_2)
# note: Decompose Structural Model
decompose = DynamoSAP.Assembly.StructuralModel.Decompose(SAPModel_2)
code_block = CodeBlock(x=decompose.out1) { x[0]; }
# note: Decompose Frame
decompose_2 = DynamoSAP.Structure.Frame.Decompose(code_block)
# note: Decompose Section Property
decompose_3 = DynamoSAP.Definitions.SectionProp.Decompose(decompose_2.out1)
