# Dynamo graph Sample_3a_RunAnalysis_ReadResults.dyn (Dynamo 0.8.0.950)

# note: Set boolean to True to run the analysis on SAP
# note: Open the sample file supplied 3a_RunAnalysis.sdb in SAP
boolean = BoolSelector(true)
# note: Get the structural elements and definitions in the model
run = DynamoSAP.Analysis.Analysis.Run(boolean)
integer_slider = IntegerSlider(3, range=0..5 step 1)
# note: Select a Load Case or Load Pattern to get results and visualize them
getItemAtIndex = List.GetItemAtIndex(list=run.out1, index=integer_slider)
# note: Set the boolean to true to get the results
boolean_2 = BoolSelector(true)
# note: Get results for a specific load case or load pattern
getResults = DynamoSAP.Analysis.Analysis.GetResults(getItemAtIndex, boolean_2)
# note: Select which type of force/moment to view
forceTypes = ForceTypes("Axial")
# note: Set the boolean to true to visualize the results
boolean_3 = BoolSelector(true)
number_slider = DoubleSlider(0.5, range=0..10 step 0.1)
# note: Visualize the results
visualizeResults = DynamoSAP.Analysis.Analysis.VisualizeResults(run.out0, getResults, forceTypes, boolean_3, number_slider)
# note: Use Structural Model.Decompose to preview the geometry of the structural members
decompose = DynamoSAP.Assembly.StructuralModel.Decompose(run.out0)
# note: Get the numeric values of the results
decomposeResults = DynamoSAP.Analysis.Analysis.DecomposeResults(run.out0, getResults, forceTypes)
watch = Watch(decomposeResults)
watch_2 = Watch(run.out1)
watch_3 = Watch(getItemAtIndex)
number_slider_2 = DoubleSlider(50, range=0..100 step 0.1)
# note: Use Frame.Display Loads to visualize the loads in the model. If no Load Pattern is passed, all the loads in the model are visualized
displayLoads = DynamoSAP.Structure.Frame.DisplayLoads(run.out0, arg4=number_slider_2)
drop_down_example = DropDownExample("Cersei")
