# Dynamo graph Sample_3b_Read_Edit_AddGroup.dyn (Dynamo 0.7.5.3566)

code_block = CodeBlock { "Beams"; }
# note: Set boolean to True to run the analysis on SAP
# note: Open the sample file supplied 3a_RunAnalysis.sdb in SAP
boolean = BoolSelector(true)
# note: Get the structural elements and definitions in the model
SAPModel = DynamoSAP.Assembly.Read.SAPModel(boolean)
# note: Use Structural Model.Decompose to preview the geometry of the structural members
decompose = DynamoSAP.Assembly.StructuralModel.Decompose(SAPModel.out0)
# note: Decompose the frames to get their base curves
decompose_2 = DynamoSAP.Structure.Frame.Decompose(decompose.out0)
# note: Get the columns and the beams in the project
python_script = Python(IN[0]=decompose_2, IN[1]=decompose.out0)
# ---------- python_script.python (23 lines) ----------
import clr
clr.AddReference('ProtoGeometry')
from Autodesk.DesignScript.Geometry import *

#The inputs to this node will be stored as a list in the IN variable.
dataEnteringNode = IN

curves=IN[0]
frames=IN[1]
beams=[]
columns=[]
geo=[]

for i in range(0,len(frames)):
	if(curves[i].EndPoint.Z==curves[i].StartPoint.Z):
		beams.append(frames[i])
	else:
		columns.append(frames[i])
		
geo.append(beams)
geo.append(columns)
#Assign your output to the OUT variable
OUT = geo
# ----------------------------------------
code_block_2 = CodeBlock(x=python_script) { x[0]; }
# note: Define the beams group
define = DynamoSAP.Definitions.Group.Define(code_block, code_block_2)
# note: Decompose the group to get an overview of your group
decompose_3 = DynamoSAP.Definitions.Group.Decompose(define)
code_block_3 = CodeBlock { "Columns"; }
code_block_4 = CodeBlock(x=python_script) { x[1]; }
# note: Define the columns group
define_2 = DynamoSAP.Definitions.Group.Define(code_block_3, code_block_4)
decompose_4 = DynamoSAP.Definitions.Group.Decompose(define_2)
# note: Gather the existing and the new definitions (the new groups in this case)
create = List.Create(decompose.out3, decompose.out4, define, define_2)
flatten = Flatten(create)
# note: Collect the structural members and the definitions
collector = DynamoSAP.Assembly.StructuralModel.Collector(decompose.out0, flatten)
boolean_2 = BoolSelector(false)
# note: Bake to SAP
# note: Set the boolean to true to update your model in SAP
toSAP = DynamoSAP.Assembly.Bake.ToSAP(collector, boolean_2, SAPModel.out1)
# note: Check how your groups were sucessfully updated in the SAP model
decompose_5 = DynamoSAP.Assembly.StructuralModel.Decompose(toSAP)
decompose_6 = DynamoSAP.Definitions.Group.Decompose(decompose_5.out6)
