# Dynamo graph Space_structure.dyn (Dynamo 0.7.6.3446)

code_block = CodeBlock { 5; }
code_block_2 = CodeBlock(n=code_block) { 0..#n..7; }
byCoordinates = Point.ByCoordinates(arg1=code_block_2)
code_block_3 = CodeBlock { 5; }
code_block_4 = CodeBlock { 7; }
code_block_5 = CodeBlock { 5; }
code_block_6 = CodeBlock { 10; }
code_block_7 = CodeBlock { 7; }
create = List.Create(code_block_3, code_block_4, code_block_5, code_block_6, code_block_7)
code_block_8 = CodeBlock { 0; }
ofRepeatedItem = List.OfRepeatedItem(code_block_8, code_block)
code_block_9 = CodeBlock { 180; }
ofRepeatedItem_2 = List.OfRepeatedItem(code_block_9, code_block)
YAxis = Vector.YAxis()
ofRepeatedItem_3 = List.OfRepeatedItem(YAxis, code_block)
byCenterPointRadiusAngle = Arc.ByCenterPointRadiusAngle(byCoordinates, create, ofRepeatedItem, ofRepeatedItem_2, ofRepeatedItem_3)
byLoft = PolySurface.ByLoft(byCenterPointRadiusAngle)
code_block_10 = CodeBlock { 11; }
code_block_11 = CodeBlock { 15; }
python_script = Python(IN[0]=byLoft, IN[1]=code_block_10, IN[2]=code_block_11)
# ---------- python_script.python (55 lines) ----------
#Copyright(c) 2014, Nathan Miller
# The Proving Ground, http://theprovingground.org

import clr
clr.AddReference('ProtoGeometry')
from Autodesk.DesignScript.Geometry import *

#The input to this node will be stored in the IN[0] variable.
srf = IN[0]

udiv = IN[1]
vdiv = IN[2]

ustep = 1.0/udiv
vstep = 1.0/vdiv

lnsA = []
lnsB = []
lnsC = []
lns = []
for i in range(0,int(udiv)+1):
	for j in range(0,int(vdiv)+1):
		lnB = []
		lnA = []
		lnC = []
		
		ptA = srf.PointAtParameter(i*ustep, j*vstep)
		if i<udiv:
			ptB = srf.PointAtParameter((i+1)*ustep, j*vstep)
			lnA.append(ptA)
			lnA.append(ptB)
			
			ln = Line.ByBestFitThroughPoints(lnA)
			lnsA.append(ln)
		if j<vdiv:
			ptB = srf.PointAtParameter(i*ustep, (j+1)*vstep)
			lnB.append(ptA)
			lnB.append(ptB)
			
			ln = Line.ByBestFitThroughPoints(lnB)
			lnsB.append(ln)
		if i<udiv and j<vdiv:
			bptA = srf.PointAtParameter(i * ustep, j * vstep)
			bptB = srf.PointAtParameter((i + 1) * ustep, (j + 1) * vstep)
			lnC.append(bptA)
			lnC.append(bptB)
			
			ln = Line.ByBestFitThroughPoints(lnC)
			lnsC.append(ln)

lns.append(lnsA)
lns.append(lnsB)
lns.append(lnsC)
#Assign your output to the OUT variable
OUT = lns
# ----------------------------------------
watch_3d = Watch3D(python_script)
code_block_12 = CodeBlock { 0; }
getItemAtIndex = List.GetItemAtIndex(python_script, code_block_12)
define = DynamoSAP.Structure.SectionProp.Define()
fromLine = DynamoSAP.Structure.Frame.FromLine(getItemAtIndex, define)
code_block_13 = CodeBlock { "Space Structure pattern"; }
loadPatternTypeDropDown = LoadPatternTypeDropDown("LTYPE_DEAD")
code_block_14 = CodeBlock { 1; }
setLoadPattern = DynamoSAP.Structure.LoadPattern.SetLoadPattern(code_block_13, loadPatternTypeDropDown, code_block_14)
code_block_15 = CodeBlock { 1; }
code_block_16 = CodeBlock { 4; }
code_block_17 = CodeBlock { 0; }
code_block_18 = CodeBlock { 1; }
code_block_19 = CodeBlock { 10; }
distributedLoadOnFrame = DynamoSAP.Structure.Load.DistributedLoadOnFrame(setLoadPattern, code_block_15, code_block_16, code_block_17, code_block_18, code_block_19, code_block_19)
setLoad = DynamoSAP.Structure.Frame.SetLoad(fromLine, distributedLoadOnFrame)
code_block_20 = CodeBlock { 1; }
getItemAtIndex_2 = List.GetItemAtIndex(python_script, code_block_20)
fromLine_2 = DynamoSAP.Structure.Frame.FromLine(getItemAtIndex_2, define)
code_block_21 = CodeBlock { 2; }
getItemAtIndex_3 = List.GetItemAtIndex(python_script, code_block_21)
fromLine_3 = DynamoSAP.Structure.Frame.FromLine(getItemAtIndex_3, define)
create_2 = List.Create(setLoad, fromLine_2, fromLine_3)
flatten = Flatten(create_2)
code_block_22 = CodeBlock { 0.01; }
boolean = BoolSelector(false)
code_block_23 = CodeBlock { 0.1; }
displayLoads = DynamoSAP.Structure.Frame.DisplayLoads(flatten, code_block_13, code_block_22, boolean, code_block_23)
decompose = DynamoSAP.Structure.Frame.Decompose(flatten)
boolean_2 = BoolSelector(true)
run = DynamoSAP.Analysis.Analysis.Run(boolean_2)
integer_slider = IntegerSlider(2, range=0..100)
getItemAtIndex_4 = List.GetItemAtIndex(run.out1, integer_slider)
getResults = DynamoSAP.Analysis.Analysis.GetResults(getItemAtIndex_4, boolean_2)
forceTypeDropDown = ForceTypeDropdown("Moment33")
decomposeResults = DynamoSAP.Analysis.Analysis.DecomposeResults(run.out0, getResults, forceTypeDropDown)
code_block_24 = CodeBlock { 0.001; }
boolean_3 = BoolSelector(true)
visualizeResults = DynamoSAP.Analysis.Analysis.VisualizeResults(run.out0, getResults, forceTypeDropDown, code_block_24, boolean_3)
SAPModel = DynamoSAP.Assembly.Read.SAPModel(boolean_2)
decompose_2 = DynamoSAP.Assembly.StructuralModel.Decompose(SAPModel)
decompose_3 = DynamoSAP.Structure.Frame.Decompose(decompose_2)
code_block_25 = CodeBlock { "Space structure LC"; }
code_block_26 = CodeBlock { 1.2; }
loadCaseTypeDropDown = LoadCaseTypeDropDown("CASE_LINEAR_STATIC")
setLoadCase = DynamoSAP.Structure.LoadCase.SetLoadCase(code_block_25, setLoadPattern, code_block_26, loadCaseTypeDropDown)
endPoint = Curve.EndPoint(getItemAtIndex)
startPoint = Curve.StartPoint(getItemAtIndex)
create_3 = List.Create(endPoint, startPoint)
flatten_2 = Flatten(create_3)
Z = Vector.Z(flatten_2)
python_script_2 = Python(IN[0]=Z, IN[1]=flatten_2)
# ---------- python_script_2.python (15 lines) ----------
import clr
clr.AddReference('ProtoGeometry')
from Autodesk.DesignScript.Geometry import *


#The inputs to this node will be stored as a list in the IN variable.
dataEnteringNode = IN
pt=[]
for i in range(0,IN[0].Count,1):
 	if(round(IN[0][i],2)==0.0):
 		
 		pt.append(IN[1][i])

#Assign your output to the OUT variable
OUT = pt
# ----------------------------------------
pinned = DynamoSAP.Structure.Restraint.Pinned(python_script_2)
collector = DynamoSAP.Assembly.StructuralModel.Collector(flatten, setLoadPattern, setLoadCase, pinned)
boolean_4 = BoolSelector(true)
toSAP = DynamoSAP.Assembly.Bake.ToSAP(collector, boolean_4)
decompose_4 = DynamoSAP.Assembly.StructuralModel.Decompose(toSAP)
