# Dynamo graph TT_workshop_beam_sample.dyn (Dynamo 0.7.5.3566)

byCoordinates = Point.ByCoordinates()
# note: Plug column bottom points
fromPoint = DynamoSAP.Structure.Joint.FromPoint(byCoordinates)
pinned = DynamoSAP.Definitions.Restraint.Pinned()
# note: RESTRAINTS
setRestraint = DynamoSAP.Structure.Joint.SetRestraint(fromPoint, pinned)
length = DoubleSlider(42.85988297, range=0..100)
byCoordinates_2 = Point.ByCoordinates(length)
fromPoint_2 = DynamoSAP.Structure.Joint.FromPoint(byCoordinates_2)
setRestraint_2 = DynamoSAP.Structure.Joint.SetRestraint(fromPoint_2, pinned)
sectionCatalogs = SectionCatalogs("Aluminum")
sections = DynamoSAP.Definitions.SectionProp.Sections(sectionCatalogs)
watch = Watch(sections)
integer_slider = IntegerSlider(68, range=0..100)
getItemAtIndex = List.GetItemAtIndex(watch, integer_slider)
watch_2 = Watch(getItemAtIndex)
materials = Materials("A36")
# note: SECTION PROPERTY
define = DynamoSAP.Definitions.SectionProp.Define(watch_2, materials, sectionCatalogs)
# note: BEAM FRAME
fromEndPoints = DynamoSAP.Structure.Frame.FromEndPoints(byCoordinates, byCoordinates_2, define)
string = StringInput("CORE_Load_Sample")
loadPatternTypes = LoadPatternTypes("LTYPE_DEAD")
double_slider = DoubleSlider(1.25, range=0..100)
# note: LOAD PATTERN
setLoadPattern = DynamoSAP.Definitions.LoadPattern.SetLoadPattern(string, loadPatternTypes, double_slider)
loadType = LoadType("Force")
loadDirection = LoadDirection("b_GlobalZ")
double_slider_2 = DoubleSlider(0, range=0..1)
double_slider_3 = DoubleSlider(1, range=0..1)
double_slider_4 = DoubleSlider(-62.09720758, range=-100..0)
double_slider_5 = DoubleSlider(-100, range=-100..150)
coordinateSystem = CoordinateSystem("Global")
# note: DISTRIBUTED LOAD
distributedLoad = DynamoSAP.Definitions.Load.DistributedLoad(setLoadPattern, loadType, loadDirection, double_slider_2, double_slider_3, double_slider_4, double_slider_5, coordinateSystem)
# note: BEAM FRAME w/LOAD
setLoad = DynamoSAP.Structure.Frame.SetLoad(fromEndPoints, distributedLoad)
create = List.Create(setRestraint, setRestraint_2, setLoad)
string_2 = StringInput("CORE_LoadCase_Sample")
double_slider_6 = DoubleSlider(1.2, range=0..100)
loadCaseTypes = LoadCaseTypes("CASE_LINEAR_STATIC")
# note: LOAD CASE
setLoadCase = DynamoSAP.Definitions.LoadCase.SetLoadCase(string_2, setLoadPattern, double_slider_6, loadCaseTypes)
# note: ALL THE DEFINITIONS IN THE PROJECT
create_2 = List.Create(setLoadPattern, setLoadCase)
# note: COLLECTOR
collector = DynamoSAP.Assembly.StructuralModel.Collector(create, create_2)
boolean = BoolSelector(false)
units = Units("N_m_C")
# note: TRANSLATION INTO SAP
toSAP = DynamoSAP.Assembly.Bake.ToSAP(collector, boolean, units)
double_slider_7 = DoubleSlider(0.859, range=0..2)
boolean_2 = BoolSelector(true)
double_slider_8 = DoubleSlider(2, range=0..2)
# note: DISPLAY LOADS IN DYNAMO
displayLoads = DynamoSAP.Structure.Frame.DisplayLoads(collector, arg2=double_slider_7, arg3=boolean_2, arg4=double_slider_8)
boolean_3 = BoolSelector(false)
run = DynamoSAP.Analysis.Analysis.Run(boolean_3)
watch_3 = Watch(run.out2)
integer_slider_2 = IntegerSlider(1, range=0..5)
getItemAtIndex_2 = List.GetItemAtIndex(watch_3, integer_slider_2)
# note: Load Case to get results of
watch_4 = Watch(getItemAtIndex_2)
boolean_4 = BoolSelector(true)
getResults = DynamoSAP.Analysis.Analysis.GetResults(watch_4, boolean_4)
forceTypes = ForceTypes("Moment33")
decomposeResults = DynamoSAP.Analysis.Analysis.DecomposeResults(run.out0, getResults, forceTypes)
watch_5 = Watch(decomposeResults)
double_slider_9 = DoubleSlider(0.2551702934, range=0..10)
visualizeResults = DynamoSAP.Analysis.Analysis.VisualizeResults(run.out0, getResults, forceTypes, boolean_4, double_slider_9)
