# Dynamo graph TT_workshop_importToRevit.dyn (Dynamo 0.7.5.3566)

# note: STEP 03: SET UP THE LOAD PATTERN.
load_pattern_name = StringInput("CORE_Load_Sample")
loadPatternTypes = LoadPatternTypes("LTYPE_DEAD")
multiplier = DoubleSlider(1.25, range=0..100)
# note: LOAD PATTERN
setLoadPattern = DynamoSAP.Definitions.LoadPattern.SetLoadPattern(load_pattern_name, loadPatternTypes, multiplier)
# note: STEP 06: SET UP THE LOAD CASE
load_case_name = StringInput("CORE_LoadCase_Sample")
scale_factor = DoubleSlider(1.2, range=0..100)
loadCaseTypes = LoadCaseTypes("CASE_LINEAR_STATIC")
# note: LOAD CASE
setLoadCase = DynamoSAP.Definitions.LoadCase.SetLoadCase(load_case_name, setLoadPattern, scale_factor, loadCaseTypes)
# note: STEP 08: GET ALL THE DEFINITIONS IN THE PROJECT
create = List.Create(setLoadPattern, setLoadCase)
# note: STEP 09: USE THE COLLECTOR TO CREATE A STRUCTURAL MODEL THAT SAP CAN READ
collector = DynamoSAP.Assembly.StructuralModel.Collector()
# note: STEP 11: SET BAKE TO TRUE TO EXPORT TO SAP
bake = BoolSelector(true)
units = Units("N_m_C")
toSAP = DynamoSAP.Assembly.Bake.ToSAP(collector, bake, units)
# note: STEP 10: PREVIEW LOADS IN DYNAMO
visualization_size = DoubleSlider(0.859, range=0..2)
show_values = BoolSelector(true)
text_size = DoubleSlider(2, range=0..2)
displayLoads = DynamoSAP.Structure.Frame.DisplayLoads(collector, arg2=visualization_size, arg3=show_values, arg4=text_size)
byCoordinates = Point.ByCoordinates()
# note: STEP 05: SET UP THE JOINT RESTRAINTS
fromPoint = DynamoSAP.Structure.Joint.FromPoint(byCoordinates)
pinned = DynamoSAP.Definitions.Restraint.Pinned()
# note: RESTRAINTS
setRestraint = DynamoSAP.Structure.Joint.SetRestraint(fromPoint, pinned)
# note: STEP 01: SET UP THE LENGTH OF THE BEAM
length_of_the_beam_in_the_x = DoubleSlider(5, range=0..100)  # "length of the beam in the x direction"
height_of_the_j_end = DoubleSlider(0, range=0..100)
byCoordinates_2 = Point.ByCoordinates(length_of_the_beam_in_the_x, arg2=height_of_the_j_end)
fromPoint_2 = DynamoSAP.Structure.Joint.FromPoint(byCoordinates_2)
roller = DynamoSAP.Definitions.Restraint.Roller()
setRestraint_2 = DynamoSAP.Structure.Joint.SetRestraint(fromPoint_2, roller)
# note: Choose the SAP catalog to read. Make sure to have a blank file open in SAP before running this
sectionCatalogs = SectionCatalogs("BSShapes")
# note: STEP 02: SET UP THE SECTION OF THE BEAM
sections = DynamoSAP.Definitions.SectionProp.Sections(sectionCatalogs)
watch = Watch(sections)
index_of_the_profile_to_use = IntegerSlider(18, range=0..25)
getItemAtIndex = List.GetItemAtIndex(watch, index_of_the_profile_to_use)
profile_selected = Watch(getItemAtIndex)
materials = Materials("A36")
# note: SECTION PROPERTY
define = DynamoSAP.Definitions.SectionProp.Define(profile_selected, materials, sectionCatalogs)
# note: BEAM FRAME
fromEndPoints = DynamoSAP.Structure.Frame.FromEndPoints(byCoordinates, byCoordinates_2, define)
# note: STEP 04: SET UP THE LOAD ON THE BEAM
loadType = LoadType("Force")
loadDirection = LoadDirection("b_GlobalZ")
distance = DoubleSlider(0, range=0..1)
distance2 = DoubleSlider(1, range=0..1)
value = DoubleSlider(-50, range=-100..0)
value2 = DoubleSlider(-50, range=-100..150)
coordinateSystem = CoordinateSystem("Global")
# note: DISTRIBUTED LOAD
distributedLoad = DynamoSAP.Definitions.Load.DistributedLoad(setLoadPattern, loadType, loadDirection, distance, distance2, value, value2, coordinateSystem)
# note: BEAM FRAME w/LOAD
setLoad = DynamoSAP.Structure.Frame.SetLoad(fromEndPoints, distributedLoad)
# note: STEP 07: GET ALL THE STRUCTURAL ELEMENTS IN THE PROJECT
create_2 = List.Create(setRestraint, setRestraint_2, setLoad)
# note: STEP 12: SET RUN TO TRUE TO ANALYZE THE STRUCTURAL MODEL
run = BoolSelector(false)
run_2 = DynamoSAP.Analysis.Analysis.Run(run)
load_patterns_in_the_sap_model = Watch(run_2.out2)
index_of_the_load_pattern_to_get = IntegerSlider(1, range=0..1)  # "Index of the load pattern to get results of"
getItemAtIndex_2 = List.GetItemAtIndex(load_patterns_in_the_sap_model, index_of_the_load_pattern_to_get)
load_case_to_get_results_of = Watch(getItemAtIndex_2)
# note: STEP 13: SET GET RESULTS TO TRUE TO SEE THE VISUALIZATION AND THE NUMBERICAL RESULTS OF THE ANALYSIS
get_results = BoolSelector(true)
getResults = DynamoSAP.Analysis.Analysis.GetResults(load_case_to_get_results_of, get_results)
# note: STEP 15: DECOMPOSE RESULTS
forceTypes = ForceTypes("Axial")
# note: STEP 14: VISUALIZE RESULTS
scale = DoubleSlider(1.552, range=0..10)
visualizeResults = DynamoSAP.Analysis.Analysis.VisualizeResults(run_2.out0, getResults, forceTypes, get_results, scale)
decomposeResults = DynamoSAP.Analysis.Analysis.DecomposeResults(run_2.out0, getResults, forceTypes)
result_values = Watch(decomposeResults)
byStartPointEndPoint = Line.ByStartPointEndPoint(byCoordinates, byCoordinates_2)
levels = Levels("L01-T/SLAB")
structural_framing_types = StructuralFramingTypes("W12X26")
beamByCurve = StructuralFraming.BeamByCurve(byStartPointEndPoint, levels, structural_framing_types)
watch_2 = Watch(structural_framing_types)
fromLine = DynamoSAP.Structure.Frame.FromLine(byStartPointEndPoint, define)
