# Dynamo graph TT_workshop_one_bay_sample.dyn (Dynamo 0.7.5.3566)

double_slider = DoubleSlider(0.05, range=0..10)
byCoordinates = Point.ByCoordinates()
length = DoubleSlider(59.216, range=0..100)
byCoordinates_2 = Point.ByCoordinates(length)
byStartPointEndPoint = Line.ByStartPointEndPoint(byCoordinates, byCoordinates_2)
number_of_divisions = IntegerSlider(8, range=2..20)
# note: Bottom lines
divideEqually = Curve.DivideEqually(byStartPointEndPoint, number_of_divisions)
# note: Plug bottom lines
startPoint = Curve.StartPoint(divideEqually)
endPoint = Curve.EndPoint(divideEqually)
lastItem = List.LastItem(endPoint)
create = List.Create(startPoint, lastItem)
# note: Column bottom points
flatten = Flatten(create)
fromPoint = DynamoSAP.Structure.Joint.FromPoint(flatten)
pinned = DynamoSAP.Definitions.Restraint.Pinned()
setRestraint = DynamoSAP.Structure.Joint.SetRestraint(fromPoint, pinned)
height = DoubleSlider(4.194709215, range=1..20)
byCoordinates_3 = Vector.ByCoordinates(arg2=height)
translate = Geometry.Translate(byStartPointEndPoint, byCoordinates_3)
# note: Top lines
divideEqually_2 = Curve.DivideEqually(translate, number_of_divisions)
# note: Plug top lines
startPoint_2 = Curve.StartPoint(divideEqually_2)
endPoint_2 = Curve.EndPoint(divideEqually_2)
lastItem_2 = List.LastItem(endPoint_2)
create_2 = List.Create(startPoint_2, lastItem_2)
# note: Column top points
flatten_2 = Flatten(create_2)
sectionCatalogs = SectionCatalogs("AISC14")
sections = DynamoSAP.Definitions.SectionProp.Sections(sectionCatalogs)
watch = Watch(sections)
integer_slider = IntegerSlider(8, range=0..100)
getItemAtIndex = List.GetItemAtIndex(watch, integer_slider)
watch_2 = Watch(getItemAtIndex)
materials = Materials("A36")
define = DynamoSAP.Definitions.SectionProp.Define(watch_2, materials, sectionCatalogs)
# note: COLUMN FRAMES
fromEndPoints = DynamoSAP.Structure.Frame.FromEndPoints(flatten, flatten_2, define)
# note: BEAM FRAMES
fromEndPoints_2 = DynamoSAP.Structure.Frame.FromEndPoints(startPoint_2, endPoint_2, define)
string = StringInput("Dead_Load_Sample")
loadPatternTypes = LoadPatternTypes("LTYPE_DEAD")
double_slider_2 = DoubleSlider(1.25, range=0..100)
# note: LOAD PATTERN
setLoadPattern = DynamoSAP.Definitions.LoadPattern.SetLoadPattern(string, loadPatternTypes, double_slider_2)
loadType = LoadType("Force")
loadDirection = LoadDirection("b_GlobalZ")
double_slider_3 = DoubleSlider(0.177421068, range=0..1)
double_slider_4 = DoubleSlider(0.7923416879, range=0..1)
double_slider_5 = DoubleSlider(-55.48551919, range=-100..0)
double_slider_6 = DoubleSlider(79.31772056, range=-100..150)
distributedLoad = DynamoSAP.Definitions.Load.DistributedLoad(setLoadPattern, loadType, loadDirection, double_slider_3, double_slider_4, double_slider_5, double_slider_6)
# note: BEAM FRAMES w/LOADS
setLoad = DynamoSAP.Structure.Frame.SetLoad(fromEndPoints_2, distributedLoad)
create_3 = List.Create(setRestraint, fromEndPoints, setLoad)
# note: ALL THE STRUCTURAL ELEMENTS IN THE PROJECT
flatten_3 = Flatten(create_3)
string_2 = StringInput("Load_Case_Sample")
double_slider_7 = DoubleSlider(1.2, range=0..100)
loadCaseTypes = LoadCaseTypes("CASE_LINEAR_STATIC")
# note: LOAD CASE
setLoadCase = DynamoSAP.Definitions.LoadCase.SetLoadCase(string_2, setLoadPattern, double_slider_7, loadCaseTypes)
create_4 = List.Create(setLoadPattern, setLoadCase)
# note: ALL THE DEFINITIONS IN THE PROJECT
flatten_4 = Flatten(create_4)
# note: COLLECTOR
collector = DynamoSAP.Assembly.StructuralModel.Collector(flatten_3, flatten_4)
boolean = BoolSelector(true)
units = Units("N_m_C")
boolean_2 = BoolSelector(true)
# note: TRANSLATION INTO SAP
toSAP = DynamoSAP.Assembly.Bake.ToSAP(collector, boolean, units, boolean_2)
double_slider_8 = DoubleSlider(0.859, range=0..2)
boolean_3 = BoolSelector(true)
double_slider_9 = DoubleSlider(1.019, range=0..2)
displayLoads = DynamoSAP.Structure.Frame.DisplayLoads(collector, arg2=double_slider_8, arg3=boolean_3, arg4=double_slider_9)
boolean_4 = BoolSelector(false)
run = DynamoSAP.Analysis.Analysis.Run(boolean_4)
watch_3 = Watch(run.out2)
integer_slider_2 = IntegerSlider(0, range=0..5)
getItemAtIndex_2 = List.GetItemAtIndex(watch_3, integer_slider_2)
watch_4 = Watch(getItemAtIndex_2)
boolean_5 = BoolSelector(true)
getResults = DynamoSAP.Analysis.Analysis.GetResults(watch_4, boolean_5)
forceTypes = ForceTypes("Axial")
decomposeResults = DynamoSAP.Analysis.Analysis.DecomposeResults(run.out0, getResults, forceTypes)
watch_5 = Watch(decomposeResults)
visualizeResults = DynamoSAP.Analysis.Analysis.VisualizeResults(run.out0, getResults, forceTypes, boolean_5)
decompose = DynamoSAP.Assembly.StructuralModel.Decompose(run.out0)
