# Dynamo graph TT_workshop_portal_sample.dyn (Dynamo 0.7.5.3566)

double_slider = DoubleSlider(0.05, range=0..10)
byCoordinates = Point.ByCoordinates()
length_in_the_y_direction = DoubleSlider(63.756, range=0..100)
byCoordinates_2 = Point.ByCoordinates(arg1=length_in_the_y_direction)
byStartPointEndPoint = Line.ByStartPointEndPoint(byCoordinates, byCoordinates_2)
number_of_divisions_in_the_x = IntegerSlider(9, range=2..20)  # "Number of divisions in the X direction"
# note: Bottom lines
divideEqually = Curve.DivideEqually(byStartPointEndPoint, number_of_divisions_in_the_x)
# note: Plug bottom lines
startPoint = Curve.StartPoint(divideEqually)
endPoint = Curve.EndPoint(divideEqually)
lastItem = List.LastItem(endPoint)
create = List.Create(startPoint, lastItem)
# note: Support points
flatten = Flatten(create)
code_block = CodeBlock { 0; }
number_of_divisions_in_the_y = IntegerSlider(7, range=2..20)  # "Number of divisions in the Y direction"
spacing_in_the_x_direction = DoubleSlider(21.582, range=0..100)
number_sequence = NumberSeq(code_block, number_of_divisions_in_the_y, spacing_in_the_x_direction, lacing=Longest)
byCoordinates_3 = Vector.ByCoordinates(number_sequence)
# note: Plug support points
translate = Geometry.Translate(flatten, byCoordinates_3, lacing=CrossProduct)
# note: All the support points
flatten_2 = Flatten(translate)
fromPoint = DynamoSAP.Structure.Joint.FromPoint(flatten_2)
pinned = DynamoSAP.Definitions.Restraint.Pinned()
setRestraint = DynamoSAP.Structure.Joint.SetRestraint(fromPoint, pinned)
height = DoubleSlider(12.675, range=0..100)
byCoordinates_4 = Vector.ByCoordinates(arg2=height)
translate_2 = Geometry.Translate(byStartPointEndPoint, byCoordinates_4)
# note: Top lines
divideEqually_2 = Curve.DivideEqually(translate_2, number_of_divisions_in_the_x)
# note: Plug top lines
startPoint_2 = Curve.StartPoint(divideEqually_2)
endPoint_2 = Curve.EndPoint(divideEqually_2)
lastItem_2 = List.LastItem(endPoint_2)
create_2 = List.Create(startPoint_2, lastItem_2)
# note: Top points
flatten_3 = Flatten(create_2)
# note: Vertical lines
# note: Plug support points and top points
byStartPointEndPoint_2 = Line.ByStartPointEndPoint(flatten, flatten_3)
# note: Set lacing to Cross Product
# note: Plug vertical lines
translate_3 = Geometry.Translate(byStartPointEndPoint_2, byCoordinates_3, lacing=CrossProduct)
# note: All the columns
flatten_4 = Flatten(translate_3)
startPoint_3 = Curve.StartPoint(flatten_4)
endPoint_3 = Curve.EndPoint(flatten_4)
sectionCatalogs = SectionCatalogs("AISC14")
sections = DynamoSAP.Definitions.SectionProp.Sections(sectionCatalogs)
watch = Watch(sections)
integer_slider = IntegerSlider(0, range=0..100)
getItemAtIndex = List.GetItemAtIndex(watch, integer_slider)
watch_2 = Watch(getItemAtIndex)
materials = Materials("A36")
define = DynamoSAP.Definitions.SectionProp.Define(watch_2, materials, sectionCatalogs)
# note: COLUMN FRAMES
fromEndPoints = DynamoSAP.Structure.Frame.FromEndPoints(startPoint_3, endPoint_3, define)
# note: Plug top points
translate_4 = Geometry.Translate(flatten_3, byCoordinates_3, lacing=CrossProduct)
byPoints = PolyCurve.ByPoints(translate_4)
explode = Geometry.Explode(byPoints)
# note: All the beams in the X direction
flatten_5 = Flatten(explode)
startPoint_4 = Curve.StartPoint(flatten_5)
endPoint_4 = Curve.EndPoint(flatten_5)
integer_slider_2 = IntegerSlider(8, range=0..100)
getItemAtIndex_2 = List.GetItemAtIndex(watch, integer_slider_2)
watch_3 = Watch(getItemAtIndex_2)
define_2 = DynamoSAP.Definitions.SectionProp.Define(watch_3, materials, sectionCatalogs)
# note: BEAM FRAMES
fromEndPoints_2 = DynamoSAP.Structure.Frame.FromEndPoints(startPoint_4, endPoint_4, define_2)
string = StringInput("Dead_Load_Sample")
loadPatternTypes = LoadPatternTypes("LTYPE_DEAD")
double_slider_2 = DoubleSlider(1.25, range=0..100)
# note: LOAD PATTERN
setLoadPattern = DynamoSAP.Definitions.LoadPattern.SetLoadPattern(string, loadPatternTypes, double_slider_2)
loadType = LoadType("Force")
loadDirection = LoadDirection("b_GlobalZ")
double_slider_3 = DoubleSlider(0, range=0..1)
double_slider_4 = DoubleSlider(1, range=0..1)
double_slider_5 = DoubleSlider(-15, range=-100..0)
double_slider_6 = DoubleSlider(30, range=-100..150)
distributedLoad = DynamoSAP.Definitions.Load.DistributedLoad(setLoadPattern, loadType, loadDirection, double_slider_3, double_slider_4, double_slider_5, double_slider_6)
# note: BEAM FRAMES w/LOADS
setLoad = DynamoSAP.Structure.Frame.SetLoad(fromEndPoints_2, distributedLoad)
translate_5 = Geometry.Translate(divideEqually_2, byCoordinates_3, lacing=CrossProduct)
# note: All the beams in the Y direction
flatten_6 = Flatten(translate_5)
startPoint_5 = Curve.StartPoint(flatten_6)
endPoint_5 = Curve.EndPoint(flatten_6)
fromEndPoints_3 = DynamoSAP.Structure.Frame.FromEndPoints(startPoint_5, endPoint_5, define_2)
create_3 = List.Create(fromEndPoints, setLoad, fromEndPoints_3)
# note: ALL FRAMES IN THE PROJECT
flatten_7 = Flatten(create_3)
create_4 = List.Create(setRestraint, flatten_7)
# note: ALL THE STRUCTURAL ELEMENTS IN THE PROJECT
flatten_8 = Flatten(create_4)
string_2 = StringInput("Load_Case_Sample")
double_slider_7 = DoubleSlider(1.2, range=0..100)
loadCaseTypes = LoadCaseTypes("CASE_LINEAR_STATIC")
# note: LOAD CASE
setLoadCase = DynamoSAP.Definitions.LoadCase.SetLoadCase(string_2, setLoadPattern, double_slider_7, loadCaseTypes)
create_5 = List.Create(setLoadPattern, setLoadCase)
# note: ALL THE DEFINITIONS IN THE PROJECT
flatten_9 = Flatten(create_5)
# note: COLLECTOR
collector = DynamoSAP.Assembly.StructuralModel.Collector(flatten_8, flatten_9)
boolean = BoolSelector(true)
units = Units("N_m_C")
# note: TRANSLATION INTO SAP
toSAP = DynamoSAP.Assembly.Bake.ToSAP(collector, boolean, units)
double_slider_8 = DoubleSlider(1.078, range=0..2)
boolean_2 = BoolSelector(true)
double_slider_9 = DoubleSlider(2, range=0..2)
displayLoads = DynamoSAP.Structure.Frame.DisplayLoads(collector, arg2=double_slider_8, arg3=boolean_2, arg4=double_slider_9)
boolean_3 = BoolSelector(true)
run = DynamoSAP.Analysis.Analysis.Run(boolean_3)
watch_4 = Watch(run.out2)
integer_slider_3 = IntegerSlider(0, range=0..5)
getItemAtIndex_3 = List.GetItemAtIndex(watch_4, integer_slider_3)
watch_5 = Watch(getItemAtIndex_3)
boolean_4 = BoolSelector(true)
getResults = DynamoSAP.Analysis.Analysis.GetResults(watch_5, boolean_4)
forceTypes = ForceTypes("Axial")
decomposeResults = DynamoSAP.Analysis.Analysis.DecomposeResults(run.out0, getResults, forceTypes)
watch_6 = Watch(decomposeResults)
visualizeResults = DynamoSAP.Analysis.Analysis.VisualizeResults(run.out0, getResults, forceTypes, boolean_4)
decompose = DynamoSAP.Assembly.StructuralModel.Decompose(run.out0)
