# Dynamo graph TT_workshop_readRevitModel.dyn (Dynamo 0.7.5.3566)

categories = Categories("StructuralFraming")
all_elements_of_category = ElementsOfCategory(categories)
location = Custom[Element.Location](Element_s=all_elements_of_category)  # Returns the location of an element as an XYZ (or if it's line-based the start and end point of the line), along with some booleans to help filtering the results. Use this for some element types (e.g. walls or lines) that do not work with the built-in Get Family Instance Location node.
categories_2 = Categories("StructuralColumns")
all_elements_of_category_2 = ElementsOfCategory(categories_2)
level = Custom[Element.Level](element_s=all_elements_of_category_2)  # Gets an element's level
location_2 = Custom[Element.Location](Element_s=all_elements_of_category_2)
levels = Levels("02 - Floor")
elevation = Level.Elevation(levels)
byCoordinates = Vector.ByCoordinates(arg2=elevation)
translate = Geometry.Translate(location_2.Points, byCoordinates)
byStartPointEndPoint = Line.ByStartPointEndPoint(location_2.Points, translate)
