# Dynamo graph simpletest.dyn (Dynamo 0.7.2.2921)

# note: Create Frame
byCoordinates = Point.ByCoordinates()
double_slider = DoubleSlider(47.119, range=0..100)
double_slider_2 = DoubleSlider(59.46, range=0..100)
byCoordinates_2 = Point.ByCoordinates(double_slider, double_slider_2)
code_block = CodeBlock { "Steel"; }
code_block_2 = CodeBlock { "W12x16"; }
integer_slider = IntegerSlider(4, range=0..7)
double_slider_3 = DoubleSlider(30, range=0..100)
fromEndPoints = DynamoSAP.Structure.Frame.FromEndPoints(byCoordinates, byCoordinates_2, code_block, code_block_2, integer_slider, double_slider_3)
code_block_3 = CodeBlock { "Ana_LiveLoad"; }
number = DoubleInput(3)
double_slider_4 = DoubleSlider(0, range=0..100)
setLoadPattern = DynamoSAP.Analysis.LoadPattern.SetLoadPattern(code_block_3, number, double_slider_4)
code_block_4 = CodeBlock { "Ana_DeadLoad"; }
number_2 = DoubleInput(1)
double_slider_5 = DoubleSlider(0, range=0..100)
setLoadPattern_2 = DynamoSAP.Analysis.LoadPattern.SetLoadPattern(code_block_4, number_2, double_slider_5)
create = List.Create(setLoadPattern, setLoadPattern_2)
# note: Creat Load case
code_block_5 = CodeBlock { "ElcinLoadCAse"; }
double_slider_6 = DoubleSlider(1.2, range=0..2)
double_slider_7 = DoubleSlider(1.7, range=0..2)
create_2 = List.Create(double_slider_6, double_slider_7)
setLoadCase = DynamoSAP.Analysis.LoadCase.SetLoadCase(code_block_5, create, create_2)
code_block_6 = CodeBlock { "AnaLoadCAse"; }
double_slider_8 = DoubleSlider(1.6, range=0..2)
double_slider_9 = DoubleSlider(0.5, range=0..2)
create_3 = List.Create(double_slider_8, double_slider_9)
setLoadCase_2 = DynamoSAP.Analysis.LoadCase.SetLoadCase(code_block_6, create, create_3)
create_4 = List.Create(setLoadCase, setLoadCase_2)
createSAPModel = DynamoSAP.Assembly.SAPModel.CreateSAPModel(fromEndPoints, create, create_4)
watch = Watch(createSAPModel)
# note: Create Load Patterns
name = DynamoSAP.Analysis.LoadPattern.Name(setLoadPattern)
