# Dynamo graph CaseStudy_1_Prototype.dyn (Dynamo 0.7.2.2921)

double_slider = DoubleSlider(30, range=0..100)
code_block = CodeBlock { "Steel"; }
# note: Create Frame
byCoordinates = Point.ByCoordinates()
double_slider_2 = DoubleSlider(30, range=0..100)
double_slider_3 = DoubleSlider(50, range=0..100)
byCoordinates_2 = Point.ByCoordinates(double_slider_2, double_slider_3)
fromEndPoints = DynamoSAP.Structure.Frame.FromEndPoints(byCoordinates, byCoordinates_2)
double_slider_4 = DoubleSlider(30, range=0..100)
double_slider_5 = DoubleSlider(100, range=0..100)
byCoordinates_3 = Point.ByCoordinates(double_slider_4, double_slider_5)
fromEndPoints_2 = DynamoSAP.Structure.Frame.FromEndPoints(byCoordinates_2, byCoordinates_3)
create = List.Create(fromEndPoints, fromEndPoints_2)
code_block_2 = CodeBlock { "Ana_LiveLoad"; }
loadPatternTypeDropDown = LoadPatternTypeDropDown("LTYPE_DEAD")
setLoadPattern = DynamoSAP.Analysis.LoadPattern.SetLoadPattern(code_block_2, loadPatternTypeDropDown)
code_block_3 = CodeBlock { "Ana_DeadLoad"; }
loadPatternTypeDropDown_2 = LoadPatternTypeDropDown("LTYPE_DEAD")
setLoadPattern_2 = DynamoSAP.Analysis.LoadPattern.SetLoadPattern(code_block_3, loadPatternTypeDropDown_2)
create_2 = List.Create(setLoadPattern, setLoadPattern_2)
# note: Create Load case
code_block_4 = CodeBlock { "ElcinLoadCAse"; }
double_slider_6 = DoubleSlider(1.2, range=0..2)
double_slider_7 = DoubleSlider(1.7, range=0..2)
create_3 = List.Create(double_slider_6, double_slider_7)
loadCaseTypeDropDown = LoadCaseTypeDropDown("CASE_BUCKLING")
setLoadCase = DynamoSAP.Analysis.LoadCase.SetLoadCase(code_block_4, create_2, create_3, loadCaseTypeDropDown)
code_block_5 = CodeBlock { "AnaLoadCAse"; }
double_slider_8 = DoubleSlider(1.6, range=0..2)
double_slider_9 = DoubleSlider(0.5, range=0..2)
create_4 = List.Create(double_slider_8, double_slider_9)
loadCaseTypeDropDown_2 = LoadCaseTypeDropDown("CASE_BUCKLING")
setLoadCase_2 = DynamoSAP.Analysis.LoadCase.SetLoadCase(code_block_5, create_2, create_4, loadCaseTypeDropDown_2)
create_5 = List.Create(setLoadCase, setLoadCase_2)
boolean = BoolSelector(false)
boolean_2 = BoolSelector(true)
# note: Set Restaints
setRestraint = DynamoSAP.Analysis.Restraint.SetRestraint(byCoordinates, boolean, boolean, boolean, boolean_2, boolean_2, boolean_2)
fixed = DynamoSAP.Analysis.Restraint.Fixed(byCoordinates_2)
double_slider_10 = DoubleSlider(100, range=0..100)
double_slider_11 = DoubleSlider(68.93321766, range=0..100)
byCoordinates_4 = Point.ByCoordinates(double_slider_10, double_slider_11)
roller = DynamoSAP.Analysis.Restraint.Roller(byCoordinates_4)
create_6 = List.Create(setRestraint, fixed, roller)
type_1_force_2_moment = DoubleInput(1)
load_direction_4_x_5_y_6_z = DoubleInput(5)
double_slider_12 = DoubleSlider(0.3, range=0..1)
double_slider_13 = DoubleSlider(50, range=0..100)
# note: Set Point Load
pointLoadOnFrame = DynamoSAP.Analysis.Load.PointLoadOnFrame(fromEndPoints, setLoadPattern, type_1_force_2_moment, load_direction_4_x_5_y_6_z, double_slider_12, double_slider_13)
load_direction_4_x_5_y_6_z_2 = DoubleInput(4)
double_slider_14 = DoubleSlider(0.3, range=0..1)
double_slider_15 = DoubleSlider(0.9, range=0..1)
double_slider_16 = DoubleSlider(30, range=0..100)
# note: Assemble the Sap Model
double_slider_17 = DoubleSlider(50, range=0..100)
# note: Set Distributed Load
distributedLoadOnFrame = DynamoSAP.Analysis.Load.DistributedLoadOnFrame(fromEndPoints_2, setLoadPattern_2, type_1_force_2_moment, load_direction_4_x_5_y_6_z_2, double_slider_14, double_slider_15, double_slider_16, double_slider_17)
create_7 = List.Create(pointLoadOnFrame, distributedLoadOnFrame)
createSAPModel = DynamoSAP.Assembly.SAPModel.CreateSAPModel(create, create_2, create_5, create_6, create_7)
watch = Watch(createSAPModel)
code_block_6 = CodeBlock { "W12x16"; }
# note: Create Load Patterns
name = DynamoSAP.Analysis.LoadPattern.Name(setLoadPattern)
LType = DoubleInput(3)
multiplier = DoubleSlider(2, range=0..2)
justificationDropDown = JustificationTypeDropdown("BottomLeft")
number = DoubleInput(1)
U1 = DynamoSAP.Analysis.Restraint.U1(setRestraint)
