# Dynamo graph Combination test.dyn (Dynamo 0.7.5.3566)

code_block = CodeBlock { "CombinationTest"; }
code_block_2 = CodeBlock { "Linear Additive"; }
code_block_3 = CodeBlock { "LC"; }
code_block_4 = CodeBlock { "LP"; }
loadPatternTypes = LoadPatternTypes("LTYPE_ACTIVEEARTHPRESSURE")
setLoadPattern = DynamoSAP.Definitions.LoadPattern.SetLoadPattern(code_block_4, loadPatternTypes)
code_block_5 = CodeBlock { 2.0; }
loadCaseTypes = LoadCaseTypes("CASE_LINEAR_STATIC")
setLoadCase = DynamoSAP.Definitions.LoadCase.SetLoadCase(code_block_3, setLoadPattern, code_block_5, loadCaseTypes)
code_block_6 = CodeBlock { "LC2"; }
code_block_7 = CodeBlock { 5; }
loadCaseTypes_2 = LoadCaseTypes("CASE_LINEAR_STATIC")
setLoadCase_2 = DynamoSAP.Definitions.LoadCase.SetLoadCase(code_block_6, setLoadPattern, code_block_7, loadCaseTypes_2)
create = List.Create(setLoadCase, setLoadCase_2)
code_block_8 = CodeBlock { 1.2; }
code_block_9 = CodeBlock { 2; }
create_2 = List.Create(code_block_8, code_block_9)
setLoadCombo = DynamoSAP.Definitions.LoadCombo.SetLoadCombo(code_block, code_block_2, create, create_2)
decompose = DynamoSAP.Definitions.LoadCombo.Decompose(setLoadCombo)
decompose_2 = DynamoSAP.Definitions.LoadCase.Decompose(decompose.out2)
byCoordinates = Point.ByCoordinates()
code_block_10 = CodeBlock { 10; }
byCoordinates_2 = Point.ByCoordinates(arg1=code_block_10)
define = DynamoSAP.Definitions.SectionProp.Define()
fromEndPoints = DynamoSAP.Structure.Frame.FromEndPoints(byCoordinates, byCoordinates_2, define)
create_3 = List.Create(setLoadPattern, create, setLoadCombo)
flatten = Flatten(create_3)
collector = DynamoSAP.Assembly.StructuralModel.Collector(fromEndPoints, flatten)
boolean = BoolSelector(true)
toSAP = DynamoSAP.Assembly.Bake.ToSAP(collector, boolean)
decompose_3 = DynamoSAP.Assembly.StructuralModel.Decompose(toSAP)
decompose_4 = DynamoSAP.Definitions.LoadCase.Decompose(decompose_3.out4)
setLoad = DynamoSAP.Structure.Frame.SetLoad(fromEndPoints, fromEndPoints)
pointLoad = DynamoSAP.Definitions.Load.PointLoad(setLoadPattern)
