# Dynamo graph Prototype blocks.dyn (Dynamo 0.7.3.3034)

FRAME = Formula("Curve + Material+ Section + Justification+Rotation")
load_pattern = Formula("Name + Type + Multiplier")
load_case = Formula("pattern+loadName", load_pattern)
load_pattern_2 = Formula("Name + Type + Multiplier")
PATTERNS = List.Create(load_pattern, load_pattern_2)
restraints = Formula("XX+YY+ZZ")
distributed_load = Formula("Frame+direction+amount+pattern", Frame=FRAME, pattern=load_pattern)
code_block = CodeBlock { "Vector as Vector3d"; }
point_load_on_frame = Formula("frame+t+vector+amount+pattern", frame=FRAME, vector=code_block, pattern=load_pattern_2)
LOADS = List.Create(distributed_load, point_load_on_frame)
general_structural_model = Formula("Frame+loadcase+Pattern+restraints+Loads", Frame=FRAME, loadcase=load_case, Pattern=PATTERNS, restraints=restraints, Loads=LOADS)  # "GENERAL STRUCTURAL MODEL (COLLECTOR)"
BOOL = CodeBlock { "CREATE=true"; }
sap_model = CodeBlock(StructuralModel=general_structural_model, CreateSAPModelBoolean=BOOL) { StructuralModel + CreateSAPModelBoolean; }
load_case_2 = CodeBlock { "LiveLoadSample"; }
showFrameLoads = BoolSelector(true)
showJointLoads = BoolSelector(true)
display_loads = CodeBlock(SAPModel=sap_model, LoadCase=load_case_2, FrameBoolean=showFrameLoads, JointBoolean=showJointLoads) { SAPModel+LoadCase+FrameBoolean+JointBoolean; }
BOOL_2 = CodeBlock { "ANALYZE=true"; }
file_path_to_save_the_results = CodeBlock { "myFilePath"; }
# note: Default Load Case: run all cases?
# Default File Path: create new one in User/Documents/...
ANALYZE = CodeBlock(SAPModel=sap_model, RunAnalysisBoolean=BOOL_2, OptionalLoadCase=load_case_2, OptionalFilePath=file_path_to_save_the_results) { SAPModel+RunAnalysisBoolean+OptionalLoadCase+OptionalFilePath; }
# note: This must show an error if the analysis has not been run
get_results = CodeBlock(Results=ANALYZE, LoadCase=load_case_2) { Results+LoadCase; }
list_of_results_table = Watch(get_results)
XAxis = Vector.XAxis()
code_block_2 = CodeBlock { 10; }
scale = Vector.Scale(XAxis, code_block_2)
watch_3d = Watch3D(scale)
code_block_3 = CodeBlock { SucCess; }
showframeforces_stresses = BoolSelector(true)
showjointforces_stresses = BoolSelector(true)
code_block_4 = CodeBlock { "M3"; }
display_results = CodeBlock(Results=ANALYZE, LoadCase=load_case_2, FrameBoolean=showframeforces_stresses, JointBoolean=showjointforces_stresses, ResultType=code_block_4) { Results+LoadCase+FrameBoolean+JointBoolean+ResultType; }
watch_3d_2 = Watch3D(display_results)
verify_analysis_design_sections = CodeBlock(SAPModel=sap_model, LoadCase=load_case_2) { SAPModel+LoadCase; }
watch_3d_3 = Watch3D(verify_analysis_design_sections)
