# Dynamo graph Workflow_DynamoToRevitStructures_bh_001.dyn (Dynamo 0.7.2.10743)

code_block = CodeBlock { "Dynamo > Revit"; }
beam_brace_column_from_line = CodeBlock()
# ---------- beam_brace_column_from_line.designscript (3 lines) ----------
//Create beam/brace/column from line
FamilyInstance = line
+ familyType + rotation + offset + etc;
# ----------------------------------------
code_block_2 = CodeBlock(x=beam_brace_column_from_line) { x[0]; }
supportMemberEndPoint = CodeBlock(code_block_2)
# ---------- supportMemberEndPoint.designscript (3 lines) ----------
//SupportPoint on Member
Support = FamilyInstance
+ SupportType + startOrEnd;
# ----------------------------------------
code_block_3 = CodeBlock(x=beam_brace_column_from_line) { x[1]; }
createRevitLoadCase = CodeBlock()
# ---------- createRevitLoadCase.designscript (2 lines) ----------
//Create load case
LoadCase = Name + Nature + Category;
# ----------------------------------------
distributedLoadOnMember = CodeBlock(code_block_3, createRevitLoadCase)
# ---------- distributedLoadOnMember.designscript (3 lines) ----------
//distributed load on a member
Load = FamilyInstance + LoadCase + FX + FY + FZ +
Mx + My + MZ;
# ----------------------------------------
code_block_4 = CodeBlock(x=beam_brace_column_from_line) { x[2]; }
pointLoadOnMemberEndPoint = CodeBlock(code_block_4, createRevitLoadCase)
# ---------- pointLoadOnMemberEndPoint.designscript (3 lines) ----------
//distributed load on a member
Load = FamilyInstance + LoadCase + FX + FY + FZ +
Mx + My + MZ + StartOrEnd;
# ----------------------------------------
createRevitLoadCase_2 = CodeBlock()  # same code as createRevitLoadCase
create = List.Create(createRevitLoadCase, createRevitLoadCase_2)
createRevitLoadCombo = CodeBlock(arg1=create)
# ---------- createRevitLoadCombo.designscript (2 lines) ----------
//Create load combination
LoadCombo = Name + Cases + Factors;
# ----------------------------------------
