# Dynamo graph Workflow_RevitStructuresToDynamoToSapAndResultsBack_bh_001.dyn (Dynamo 0.7.2.10743)

code_block = CodeBlock { "Revit > Dynamo > SAP,"; "Run Sap Analysis"; "Write Results in Revit"; }
code_block_2 = CodeBlock()
# ---------- code_block_2.designscript (3 lines) ----------
//Select Revit Elements
//or a Filter on the doc;
1123;
# ----------------------------------------
code_block_3 = CodeBlock { "StartAxial"; }
boolean = BoolSelector(false)
newBlankSapModel = CodeBlock(run=boolean)
# ---------- newBlankSapModel.designscript (2 lines) ----------
//New blank SAP model
SAPmodel = run;
# ----------------------------------------
getAnalyticalModel = CodeBlock(elem=code_block_2)
# ---------- getAnalyticalModel.designscript (3 lines) ----------
//get the analytical
//model from an element;
elem;
# ----------------------------------------
supportsFromAnalyticalModel = CodeBlock(AnalyticalModel=getAnalyticalModel)
# ---------- supportsFromAnalyticalModel.designscript (3 lines) ----------
//get supprts from an
//analytical model;
Supports = AnalyticalModel;
# ----------------------------------------
supportToRestraint = CodeBlock(support=supportsFromAnalyticalModel)
# ---------- supportToRestraint.designscript (3 lines) ----------
//convert revit load
//to sap load
restraint = support;
# ----------------------------------------
loadsFromAnalyticalModel = CodeBlock(AnalyticalModel=getAnalyticalModel)
# ---------- loadsFromAnalyticalModel.designscript (3 lines) ----------
//get loads on an
//analytical model
Loads = AnalyticalModel;
# ----------------------------------------
revitLoadToSapLoad = CodeBlock(RevitLoad=loadsFromAnalyticalModel)
# ---------- revitLoadToSapLoad.designscript (3 lines) ----------
//convert revit load
//to sap load
SAPload = RevitLoad;
# ----------------------------------------
analyticalModelToFrame = CodeBlock(AnalyticalModel=getAnalyticalModel)
# ---------- analyticalModelToFrame.designscript (3 lines) ----------
//convert analytical model
//to sap frame
Frame = AnalyticalModel;
# ----------------------------------------
loadCasesDocumentFilter = CodeBlock()
# ---------- loadCasesDocumentFilter.designscript (2 lines) ----------
//get load cases from project;
"LoadCase";
# ----------------------------------------
loadCaseToLoadPattern = CodeBlock(LoadCase=loadCasesDocumentFilter)
# ---------- loadCaseToLoadPattern.designscript (3 lines) ----------
//convert revit load case
//into SAP load pattern
LoadPattern = LoadCase;
# ----------------------------------------
loadCombosDocumentFilter = CodeBlock()
# ---------- loadCombosDocumentFilter.designscript (2 lines) ----------
//get load combinations from project;
"LoadCombos";
# ----------------------------------------
rvtLoadComboToSapLoadCombo = CodeBlock(RvtLoadCombo=loadCombosDocumentFilter)
# ---------- rvtLoadComboToSapLoadCombo.designscript (3 lines) ----------
//convert revit load combo
//into SAP load combo
SAPloadCombo = RvtLoadCombo;
# ----------------------------------------
create = List.Create(supportToRestraint, revitLoadToSapLoad, analyticalModelToFrame, loadCaseToLoadPattern, rvtLoadComboToSapLoadCombo)
boolean_2 = BoolSelector(false)
createSapModel = CodeBlock(SAPmodel=newBlankSapModel, SAPelements=create, run=boolean_2)
# ---------- createSapModel.designscript (3 lines) ----------
//create SAP model;
SAPmodel = SAPmodel +
SAPelements + run;
# ----------------------------------------
boolean_3 = BoolSelector(false)
runSapAnalysis = CodeBlock(SAPmodel=createSapModel, LoadCombo=rvtLoadComboToSapLoadCombo, run=boolean_3)
# ---------- runSapAnalysis.designscript (3 lines) ----------
//run SAP analysis
SAPmodel = SAPmodel
+ LoadCombo + run;
# ----------------------------------------
boolean_4 = BoolSelector(false)
getFrameResultsFromSAP = CodeBlock(SAPmodel=runSapAnalysis, run=boolean_4)
# ---------- getFrameResultsFromSAP.designscript (3 lines) ----------
//get frame results
SAPmodel = SAPmodel + run;
"FrameResults";
# ----------------------------------------
decomposeFrameResult = CodeBlock(FrameResult=getFrameResultsFromSAP.out1)
# ---------- decomposeFrameResult.designscript (11 lines) ----------
//decompose frame result
FrameResult = FrameResult;
"StartAxial";
"EndAxial";
"StartMoment";
"EndMoment";
"StartShear";
"EndShear";
"InternalMoments";
"InternalMomentTValues";
"etc";
# ----------------------------------------
setRevitFamilyInstanceParam = CodeBlock(FamilyInstance=code_block_2, ParamName=code_block_3, ParamValue=decomposeFrameResult.out1)
# ---------- setRevitFamilyInstanceParam.designscript (3 lines) ----------
//set revit family instance params
FamilyInstance = FamilyInstance +
ParamName + ParamValue;
# ----------------------------------------
