# Dynamo graph Workflow_SAPDynamoSAP.dyn (Dynamo 0.7.3.3034)

updateSapModel = CodeBlock()
# ---------- updateSapModel.designscript (4 lines) ----------
def UpdateSapModel(SapModel,sapObjs)
{
 return = sapModel;
}
# ----------------------------------------
# note: Update SAP Model
# SAP --> Dynamo --> SAP
read_existing_sap_model_already = CodeBlock { ReadSapModel(); }  # "Read Existing Sap Model(already -opened)"
get_frames = CodeBlock(SapModel=read_existing_sap_model_already) { GetFrames(SapModel); }
getfirstitem = CodeBlock(x=get_frames) { x[0]; }
# note: this returns modified Frame object (guid doesnot changing) tagged as updated !
updateFrame = CodeBlock(getfirstitem) { UpdateFrm(Frm,BaseCurve,Material,SectionProfile,Justification,Rotation); }
getseconditem = CodeBlock(x=get_frames) { x[1]; }
# note: this returns modified Frame object (guid doesnot changing) tagged as delete !
deleteFrame = CodeBlock(Frm=getseconditem) { DeleteFrm(Frm); }
create = List.Create(updateFrame, deleteFrame)
updateSapModel_2 = CodeBlock(SapModel=read_existing_sap_model_already, sapObjs=create) { UpdateSapModel(SapModel,sapObjs); }
file_path = Filename("No file selected.")
read_existing_sap_model = CodeBlock(filepath=file_path) { ReadSapModel(filepath); }
baseCurve = DynamoSAP.Structure.Frame.BaseCurve(get_frames)
updateFrame_2 = CodeBlock()
# ---------- updateFrame_2.designscript (4 lines) ----------
def UpdateFrm(Frm,BaseCurve,Material,SectionProfile,Justification,Rotation)
{
 return = Frame;
}
# ----------------------------------------
deleteFrm = CodeBlock()
# ---------- deleteFrm.designscript (4 lines) ----------
def DeleteFrm(Frm)
{
 return = Frame;
}
# ----------------------------------------
