# Dynamo graph Workflow_SapToDynamo.dyn (Dynamo 0.7.2.2921)

code_block = CodeBlock()
# ---------- code_block.designscript (4 lines) ----------
def CreateSapModel(sapObjs,Units)
{
 return = sapModel;
}
# ----------------------------------------
code_block_2 = CodeBlock { CreateSapModel(sapObjs,units); }
# note: Read SapModel
read_sap_model = CodeBlock()
# ---------- read_sap_model.designscript (8 lines) ----------
def ReadSapModel()
{
 return = SapModel;
}
def ReadSapModel(filepath)
{
return = SapModel;
}
# ----------------------------------------
# note: SAP to DYNAMO
file_path = Filename("No file selected.")
read_existing_sap_model = CodeBlock(filepath=file_path) { ReadSapModel(filepath); }
get_frames = CodeBlock()
# ---------- get_frames.designscript (4 lines) ----------
def GetFrames(SapModel)
{
 return = List<Frame> frms;
}
# ----------------------------------------
deConstructFrm = CodeBlock()
# ---------- deConstructFrm.designscript (4 lines) ----------
def deConstructFrm(frame)
{
 return = {"BaseCurve","Material","SectionProfile","Justification","Rotation"};
}
# ----------------------------------------
read_existing_sap_model_already = CodeBlock { ReadSapModel(); }  # "Read Existing Sap Model(already -opened)"
# note: GetFrames returns List<Frame> Frames
get_frames_2 = CodeBlock(SapModel=read_existing_sap_model_already) { GetFrames(SapModel); }
# note: 1. Use Query Nodes
baseCurve = DynamoSAP.Structure.Frame.BaseCurve(get_frames_2)
# note: 2. Use deConstructFrm Node
deConstructFrm_2 = CodeBlock(frame=get_frames_2) { deConstructFrm(frame); }
getLoadPatterns = CodeBlock()
# ---------- getLoadPatterns.designscript (4 lines) ----------
def GetLoadPatterns(SapModel)
{
 return = List<LoadPattern> Lpatterns;
}
# ----------------------------------------
# note: GetLoadPatterns returns List<LoadPattern> LPs
get_loadpatterns = CodeBlock(SapModel=read_existing_sap_model_already) { GetLoadPatterns(SapModel); }
name = DynamoSAP.Analysis.LoadPattern.Name(get_loadpatterns)
type = DynamoSAP.Analysis.LoadPattern.Type(get_loadpatterns)
deConstructLoadPattern = CodeBlock()
# ---------- deConstructLoadPattern.designscript (4 lines) ----------
def deConstructLoadPattern(loadpattern)
{
 return = {"Name","Type","Multiplier"};
}
# ----------------------------------------
# note: 2. Use deConstructLoadPattern Node
deConstructLoadpattern = CodeBlock(loadPattern=get_loadpatterns) { deConstructLoadPattern(loadPattern); }
get_frames_3 = CodeBlock()
# ---------- get_frames_3.designscript (4 lines) ----------
def GetAreas(SapModel)
{
 return = List<saparea> areas;
}
# ----------------------------------------
# note: GetAreas returns List<Area> sapAreas
get_areas = CodeBlock(SapModel=read_existing_sap_model_already) { GetAreas(SapModel); }
surface = CodeBlock(get_areas) { x= SapArea.Srf; }  # "Area.Surface"
thickness = CodeBlock(get_areas) { x= SapArea.Thick; }  # "Area.Thickness"
# note: TODO: For Area objects (slab or wall) u can use Query Nodes , thickness and surface
thicken = Surface.Thicken(surface, thickness)
deConstructArea = CodeBlock()
# ---------- deConstructArea.designscript (4 lines) ----------
def deConstructArea(area)
{
 return = {"Srf","SectionProfile","Thickness"};
}
# ----------------------------------------
# note: 2. Use deConstructArea Node
deConstructArea_2 = CodeBlock(SapArea=get_areas) { deConstructArea(SapArea); }
deConstructLoadCase = CodeBlock()
# ---------- deConstructLoadCase.designscript (4 lines) ----------
def deConstructLoadCase(loadcase)
{
 return = {"Name","Type","LoadPatterns","SFs"};
}
# ----------------------------------------
# note: GetLoadCases returns List<LoadCases> LCs
getLoadCases = CodeBlock(SapModel=read_existing_sap_model_already) { GetLoadCases(SapModel); }
# note: 2. Use deConstructLoadCase Node
deConstructLoadCase_2 = CodeBlock(loadCase=getLoadCases) { deConstructLoadCase(loadCase); }
name_2 = DynamoSAP.Analysis.LoadCase.Name(getLoadCases)
type_2 = DynamoSAP.Analysis.LoadCase.Type(getLoadCases)
getLoadCases_2 = CodeBlock()
# ---------- getLoadCases_2.designscript (4 lines) ----------
def GetLoadCases(SapModel)
{
 return = List<LoadCase> LCases;
}
# ----------------------------------------
get_loads = CodeBlock()
# ---------- get_loads.designscript (4 lines) ----------
def GetLoads(SapModel,frms)
{
 return = List<Load> loads;
}
# ----------------------------------------
get_loads_2 = CodeBlock(SapModel=read_existing_sap_model_already, frms=get_frames_2) { GetLoads(SapModel,frms); }
LType = DynamoSAP.Analysis.Load.LType(get_loads_2)
deConstructPointLoad = CodeBlock()
# ---------- deConstructPointLoad.designscript (4 lines) ----------
def deConstructPointLoad(load)
{
 return = {"LPattern","Type","Direction","dist", "Val"};
}
# ----------------------------------------
deConstructDistributedLoad = CodeBlock()
# ---------- deConstructDistributedLoad.designscript (4 lines) ----------
def deConstructDistributedLoad(load)
{
 return = {"LPattern","Type","Direction","dist","dist2", "Val", "Val2"};
}
# ----------------------------------------
# note: 2. Use deConstructLoad Nodes
deConstructPointLoad_2 = CodeBlock(load=get_loads_2) { deConstructPointLoad(load); }
deConstructDistributedLoad_2 = CodeBlock(load=get_loads_2) { deConstructDistributedLoad(load); }
updateSapModel = CodeBlock()
# ---------- updateSapModel.designscript (4 lines) ----------
def UpdateSapModel(SapModel,sapObjs)
{
 return = sapModel;
}
# ----------------------------------------
# note: Update SAP Model
# SAP --> Dynamo --> SAP
read_existing_sap_model_already_2 = CodeBlock { ReadSapModel(); }  # "Read Existing Sap Model(already -opened)"
get_frames_4 = CodeBlock(SapModel=read_existing_sap_model_already_2) { GetFrames(SapModel); }
getfirstitem = CodeBlock(x=get_frames_4) { x[0]; }
# note: this returns modified Frame object (guid doesnot changing) tagged as updated !
updateFrame = CodeBlock(getfirstitem) { UpdateFrm(Frm,BaseCurve,Material,SectionProfile,Justification,Rotation); }
getseconditem = CodeBlock(x=get_frames_4) { x[1]; }
# note: this returns modified Frame object (guid doesnot changing) tagged as delete !
deleteFrame = CodeBlock(Frm=getseconditem) { DeleteFrm(Frm); }
create = List.Create(updateFrame, deleteFrame)
updateSapModel_2 = CodeBlock(SapModel=read_existing_sap_model_already_2, sapObjs=create) { UpdateSapModel(SapModel,sapObjs); }
file_path_2 = Filename("No file selected.")
read_existing_sap_model_2 = CodeBlock(filepath=file_path_2) { ReadSapModel(filepath); }
baseCurve_2 = DynamoSAP.Structure.Frame.BaseCurve(get_frames_4)
updateFrame_2 = CodeBlock()
# ---------- updateFrame_2.designscript (4 lines) ----------
def UpdateFrm(Frm,BaseCurve,Material,SectionProfile,Justification,Rotation)
{
 return = Frame;
}
# ----------------------------------------
deleteFrm = CodeBlock()
# ---------- deleteFrm.designscript (4 lines) ----------
def DeleteFrm(Frm)
{
 return = Frame;
}
# ----------------------------------------
