# Dynamo graph basic frame.dyn (Dynamo 0.7.5.3566)

sectionCatalogs = SectionCatalogs("AISC")
sections = DynamoSAP.Definitions.SectionProp.Sections(sectionCatalogs)
byCoordinates = Point.ByCoordinates()
code_block = CodeBlock { 5; }
code_block_2 = CodeBlock { 10; }
byCoordinates_2 = Point.ByCoordinates(code_block, code_block_2)
code_block_3 = CodeBlock { "thissection"; }
materials = Materials("A36")
define = DynamoSAP.Definitions.SectionProp.Define(code_block_3, materials, sectionCatalogs)
fromEndPoints = DynamoSAP.Structure.Frame.FromEndPoints(byCoordinates, byCoordinates_2, define)
code_block_4 = CodeBlock { "myLoadPattern"; }
loadPatternTypes = LoadPatternTypes("LTYPE_DEAD")
setLoadPattern = DynamoSAP.Definitions.LoadPattern.SetLoadPattern(code_block_4, loadPatternTypes)
code_block_5 = CodeBlock { 1; }
code_block_6 = CodeBlock { 1; }
code_block_7 = CodeBlock { 0.1; }
code_block_8 = CodeBlock { 200; }
code_block_9 = CodeBlock { "Local"; }
pointLoad = DynamoSAP.Definitions.Load.PointLoad(setLoadPattern, code_block_5, code_block_6, code_block_7, code_block_8, code_block_9)
setLoad = DynamoSAP.Structure.Frame.SetLoad(fromEndPoints, pointLoad)
code_block_10 = CodeBlock { "MyloadCase"; }
code_block_11 = CodeBlock { 1.25; }
loadCaseTypes = LoadCaseTypes("CASE_LINEAR_STATIC")
setLoadCase = DynamoSAP.Definitions.LoadCase.SetLoadCase(code_block_10, setLoadPattern, code_block_11, loadCaseTypes)
collector = DynamoSAP.Assembly.StructuralModel.Collector(setLoad, setLoadPattern, setLoadCase)
boolean = BoolSelector(true)
toSAP = DynamoSAP.Assembly.Bake.ToSAP(collector, boolean)
