# Dynamo graph portal_new version.dyn (Dynamo 0.7.5.3566)

type_1_force_2_moment = DoubleInput(1)
integer_slider = IntegerSlider(4, range=0..100)
integer_slider_2 = IntegerSlider(5, range=0..100)
integer_slider_3 = IntegerSlider(5, range=0..100)
number = DoubleInput(0)
double_slider = DoubleSlider(300, range=150..500)
double_slider_2 = DoubleSlider(500, range=150..500)
double_slider_3 = DoubleSlider(350, range=150..500)
xyzGrid = Custom[XyzGrid](x_count=integer_slider, y_count=integer_slider_2, z_count=integer_slider_3, x0=number, y0=number, z0=number, x_space=double_slider, y_space=double_slider_2, z_space=double_slider_3)  # This node represents an upgrade of the 0.6.3 XyzGrid node to 0.7.x
flatten = Flatten(xyzGrid)
formula = Formula("x*y;", x=integer_slider, y=integer_slider_2)
chop = List.Chop(flatten, formula)
number_2 = DoubleInput(0)
getItemAtIndex = List.GetItemAtIndex(chop, number_2)
create = List.Create()
transpose = List.Transpose(chop)
byPoints = PolyCurve.ByPoints(transpose)
explode = Geometry.Explode(byPoints)
number_3 = DoubleInput(5)
number_4 = DoubleInput(6)
number_5 = DoubleInput(9)
number_6 = DoubleInput(10)
create_2 = List.Create(number_3, number_4, number_5, number_6)
getItemAtIndex_2 = List.GetItemAtIndex(explode, create_2)
transpose_2 = List.Transpose(getItemAtIndex_2)
endPoint = Curve.EndPoint(transpose_2)
number_7 = DoubleInput(1)
number_8 = DoubleInput(2)
number_sequence = NumberSeq(number_7, number_8, number_7, lacing=Longest)
getItemAtIndex_3 = List.GetItemAtIndex(arg1=number_sequence)
map = List.Map(endPoint, getItemAtIndex_3)
flatten_2 = Flatten(map)
startPoint = Curve.StartPoint(transpose_2)
number_9 = DoubleInput(0)
number_10 = DoubleInput(2)
number_11 = DoubleInput(3)
number_sequence_2 = NumberSeq(number_9, number_10, number_11, lacing=Longest)
getItemAtIndex_4 = List.GetItemAtIndex(arg1=number_sequence_2)
map_2 = List.Map(startPoint, getItemAtIndex_4)
flatten_3 = Flatten(map_2)
combine = List.Combine(create, flatten_2, flatten_3)
flatten_4 = Flatten(combine)
number_12 = DoubleInput(4)
chop_2 = List.Chop(flatten_4, number_12)
boolean = BoolSelector(true)
byPoints_2 = PolyCurve.ByPoints(chop_2, boolean)
explode_2 = Geometry.Explode(byPoints_2)
# note: CORE DIAGONALS
flatten_5 = Flatten(explode_2)
startPoint_2 = Curve.StartPoint(flatten_5)
endPoint_2 = Curve.EndPoint(flatten_5)
sectionCatalogs = SectionCatalogs("AISC")
sections = DynamoSAP.Definitions.SectionProp.Sections(sectionCatalogs)
code_block = CodeBlock { 2; }
getItemAtIndex_5 = List.GetItemAtIndex(sections, code_block)
code_block_2 = CodeBlock { "Steel"; }
define = DynamoSAP.Definitions.SectionProp.Define(getItemAtIndex_5, code_block_2, sectionCatalogs)
# note: DIAGONAL FRAMES
fromEndPoints = DynamoSAP.Structure.Frame.FromEndPoints(startPoint_2, endPoint_2, define)
boolean_2 = BoolSelector(true)
# note: RELEASE
set = DynamoSAP.Definitions.Release.Set(arg9=boolean_2, arg11=boolean_2)
# note: DIAGONAL FRAMES w/RELEASES
setReleases = DynamoSAP.Structure.Frame.SetReleases(fromEndPoints, set)
boolean_3 = BoolSelector(false)
run = DynamoSAP.Analysis.Analysis.Run(boolean_3)
integer_slider_4 = IntegerSlider(3, range=0..5)
getItemAtIndex_6 = List.GetItemAtIndex(run.out2, integer_slider_4)
double_slider_4 = DoubleSlider(1.078, range=0..2)
boolean_4 = BoolSelector(true)
double_slider_5 = DoubleSlider(2, range=0..2)
displayLoads = DynamoSAP.Structure.Frame.DisplayLoads(run.out0, getItemAtIndex_6, double_slider_4, boolean_4, double_slider_5)
boolean_5 = BoolSelector(true)
getResults = DynamoSAP.Analysis.Analysis.GetResults(getItemAtIndex_6, boolean_5)
forceTypes = ForceTypes("Axial")
decomposeResults = DynamoSAP.Analysis.Analysis.DecomposeResults(run.out0, getResults, forceTypes)
double_slider_6 = DoubleSlider(0.05, range=0..10)
visualizeResults = DynamoSAP.Analysis.Analysis.VisualizeResults(run.out0, getResults, forceTypes, boolean_5, double_slider_6)
# note: COLUMNS
flatten_6 = Flatten(explode)
startPoint_3 = Curve.StartPoint(flatten_6)
endPoint_3 = Curve.EndPoint(flatten_6)
# note: COLUMN FRAMES
fromEndPoints_2 = DynamoSAP.Structure.Frame.FromEndPoints(startPoint_3, endPoint_3, define)
code_block_3 = CodeBlock { "Move_Load_Sample"; }
loadPatternTypes = LoadPatternTypes("LTYPE_MOVE")
number_13 = DoubleInput(0.75)
setLoadPattern = DynamoSAP.Definitions.LoadPattern.SetLoadPattern(code_block_3, loadPatternTypes, number_13)
code_block_4 = CodeBlock { "Force"; }
load_direction_4_x_5_y_6_z = IntegerSlider(3, range=0..100)
double_slider_7 = DoubleSlider(0.5, range=0..1)
integer_slider_5 = IntegerSlider(100, range=50..200)
# note: LOADS
pointLoad = DynamoSAP.Definitions.Load.PointLoad(setLoadPattern, code_block_4, load_direction_4_x_5_y_6_z, double_slider_7, integer_slider_5)
# note: COLUMN FRAMES w/LOADS
setLoad = DynamoSAP.Structure.Frame.SetLoad(fromEndPoints_2, pointLoad)
create_3 = List.Create()
number_14 = DoubleInput(1)
formula_2 = Formula("z-1", z=integer_slider_3)
number_sequence_3 = NumberSeq(number_14, formula_2, number_14, lacing=Longest)
getItemAtIndex_7 = List.GetItemAtIndex(chop, number_sequence_3)
flatten_7 = Flatten(getItemAtIndex_7)
chop_3 = List.Chop(flatten_7, integer_slider)
chop_4 = List.Chop(chop_3, integer_slider_2)
byPoints_3 = PolyCurve.ByPoints(chop_4)
explode_3 = Geometry.Explode(byPoints_3)
flatten_8 = Flatten()
map_3 = List.Map(explode_3, flatten_8)
number_15 = DoubleInput(0)
code_block_5 = CodeBlock(x=integer_slider, y=integer_slider_2) { x*y; }
number_sequence_4 = NumberSeq(number_15, formula_2, code_block_5, lacing=Longest)
number_16 = DoubleInput(1)
number_sequence_5 = NumberSeq(number_sequence_4, integer_slider, number_16, lacing=Longest)
number_sequence_6 = NumberSeq(number_sequence_5, integer_slider_2, integer_slider, lacing=Longest)
getItemAtIndex_8 = List.GetItemAtIndex(flatten_7, number_sequence_6)
byPoints_4 = PolyCurve.ByPoints(getItemAtIndex_8)
explode_4 = Geometry.Explode(byPoints_4)
map_4 = List.Map(explode_4, flatten_8)
combine_2 = List.Combine(create_3, map_3, map_4)
# note: BEAMS
flatten_9 = Flatten(combine_2)
startPoint_4 = Curve.StartPoint(flatten_9)
endPoint_4 = Curve.EndPoint(flatten_9)
# note: BEAM FRAMES
fromEndPoints_3 = DynamoSAP.Structure.Frame.FromEndPoints(startPoint_4, endPoint_4, define)
code_block_6 = CodeBlock { "Dead_Load_Sample"; }
loadPatternTypes_2 = LoadPatternTypes("LTYPE_DEAD")
number_17 = DoubleInput(1.6)
setLoadPattern_2 = DynamoSAP.Definitions.LoadPattern.SetLoadPattern(code_block_6, loadPatternTypes_2, number_17)
code_block_7 = CodeBlock { "Force"; }
load_direction_4_x_5_y_6_z_2 = IntegerSlider(5, range=0..100)
double_slider_8 = DoubleSlider(0, range=0..100)
double_slider_9 = DoubleSlider(1, range=0..100)
double_slider_10 = DoubleSlider(-15, range=-100..0)
distributedLoad = DynamoSAP.Definitions.Load.DistributedLoad(setLoadPattern_2, code_block_7, load_direction_4_x_5_y_6_z_2, double_slider_8, double_slider_9, double_slider_10, double_slider_10)
# note: BEAM FRAMES w/LOADS
setLoad_2 = DynamoSAP.Structure.Frame.SetLoad(fromEndPoints_3, distributedLoad)
create_4 = List.Create(setLoad, setLoad_2)
# note: ALL FRAMES IN THE PROJECT
flatten_10 = Flatten(create_4)
# note: COLLECTOR
collector = DynamoSAP.Assembly.StructuralModel.Collector(flatten_10)
# note: RESTRAINTS
pinned = DynamoSAP.Definitions.Restraint.Pinned()
create_5 = List.Create(pinned)
# note: ALL RESTRAINTS IN THE PROJECT
flatten_11 = Flatten(create_5)
decompose = DynamoSAP.Assembly.StructuralModel.Decompose(run.out0)
decompose_2 = DynamoSAP.Structure.Frame.Decompose(decompose)
code_block_8 = CodeBlock { "Live_Load_Sample"; }
loadPatternTypes_3 = LoadPatternTypes("LTYPE_LIVE")
number_18 = DoubleInput(1.25)
setLoadPattern_3 = DynamoSAP.Definitions.LoadPattern.SetLoadPattern(code_block_8, loadPatternTypes_3, number_18)
# note: LOAD PATTERNS
create_6 = List.Create(setLoadPattern_3, setLoadPattern_2, setLoadPattern)
# note: ALL LOAD PATTERNS IN THE PROJECT
flatten_12 = Flatten(create_6)
code_block_9 = CodeBlock { "Load_Case_Sample"; }
number_19 = DoubleInput(1.2)
number_20 = DoubleInput(1.3)
number_21 = DoubleInput(1.2)
create_7 = List.Create(number_19, number_20, number_21)
loadCaseTypes = LoadCaseTypes("CASE_LINEAR_STATIC")
# note: LOAD CASE
setLoadCase = DynamoSAP.Definitions.LoadCase.SetLoadCase(code_block_9, create_6, create_7, loadCaseTypes)
create_8 = List.Create(setLoadCase)
# note: ALL LOAD CASES IN THE PROJECT
flatten_13 = Flatten(create_8)
create_9 = List.Create(flatten_12, flatten_13)
flatten_14 = Flatten(create_9)
collector_2 = DynamoSAP.Assembly.StructuralModel.Collector(flatten_10, flatten_14)
# note: TRANSLATION INTO SAP
boolean_6 = BoolSelector(true)
units = Units("N_m_C")
toSAP = DynamoSAP.Assembly.Bake.ToSAP(collector_2, boolean_6, units)
